# Grasshopper definition Tinyhouse Generator.gh (Grasshopper 1.0.7)
# plug-ins: ArqiShap3D, PTComponentLibrary, Sasquatch, Pufferfish, Magnetizing_FPG

panel = Panel("C:\Users\mfls\OneDrive\Uni\Master\Code\Tinyhouse Generator\files\EpwZipUrls.csv")
python = GhPythonScript(csv_path=panel, target_lat=Slider(37.9527, range=0..90), target_lon=Slider(64.6329, range=0..90))  # -> nearest_station_url, shortest_distance
# ---------- python: Python ----------
__author__ = "mfls"
__version__ = "2024.06.07"
        
import rhinoscriptsyntax as rs
import math

nearest_station_url = None
shortest_distance = float('inf')

def haversine(lat1, lon1, lat2, lon2):
    # Convert decimal degrees to radians
    lat1, lon1, lat2, lon2 = map(math.radians, [lat1, lon1, lat2, lon2])

    # Haversine formula 
    dlat = lat2 - lat1 
    dlon = lon2 - lon1 
    a = math.sin(dlat/2)**2 + math.cos(lat1) * math.cos(lat2) * math.sin(dlon/2)**2
    c = 2 * math.asin(math.sqrt(a)) 
    r = 6371.0088 # Radius of earth
    return c * r

# CSV open and read
file = open(csv_path, 'r')
lines = file.readlines()

file.close()

# Skip the header row if it exists and doesnt include information
header = lines[0].strip().split(';')
if header[1].lower() == 'lat' and header[2].lower() == 'lon':
    lines = lines[1:]

for line in lines:
    line = line.strip("\n")
    
    # Split line with comma: creates individual lists of strings
    csvInfo = line.split(';')
    lat = float(csvInfo[1])
    lon = float(csvInfo[2])
    distance = haversine(target_lat, target_lon, lat, lon) 
    if distance < shortest_distance:
            shortest_distance = distance
            nearest_station_url = csvInfo[3]
# ---------- end python ----------
panel_2 = Panel(python.nearest_station_url)
panel_3 = Panel("Form Vorschlag")
panel_4 = Panel("Richtung Eingang")
roominstance = RoomInstance()
pt = Point(Point(-15.49653419, 2.509493191, 0))
roominstance_2 = RoomInstance()
crv = Curve(<curve referenced from the Rhino model>)
roominstance_3 = RoomInstance()
roominstance_4 = RoomInstance()
area = Area(Geometry=crv)  # -> Area, Centroid
raumhöhe = Slider(2, range=0..10)
panel_5 = Panel(area.Area)
houseinstance = HouseInstance(Boundary=crv, EntrancePoint=pt)
magnetizing_fpg = MagnetizingRooms_ES(
    HouseInstance=houseinstance,
    Iterations=Slider(900, range=0..1000),
    MaxAdjDistance=Slider(3, range=0..10),
    CellSizeM=Slider(0.8, range=0..1))  # -> Corridors, RoomBreps, RoomNames, Adjacencies, MissingAdjacences, Boundary, BoundaryOffset
geometrie_raumhöhe = GetInteger(raumhöhe, AtLeast=2, AtMost=5, Maximum=2147483647, Minimum=-2147483648, Prompt="geometrie.Raumhöhe", TreeAccess=False)
brep = Brep(magnetizing_fpg.Corridors)
brep_2 = Brep(magnetizing_fpg.RoomBreps)
join = BrepJoin(Breps=flatten([brep, brep_2]))  # -> Breps, Closed
crv_2 = Curve(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)
cluster = Cluster_2(
    brep_2=magnetizing_fpg.Corridors,
    brep=magnetizing_fpg.RoomBreps,
    txt_2=magnetizing_fpg.RoomNames,
    txt=magnetizing_fpg.Adjacencies,
    int=magnetizing_fpg.MissingAdjacences,
    crv=magnetizing_fpg.Boundary,
    crv_2=magnetizing_fpg.BoundaryOffset)
edges = BrepEdges(Brep=join.Breps)  # -> Naked, Interior, NonManifold
Z = UnitZ(Factor=geometrie_raumhöhe)
extr = Extrude(Base=crv_2, Direction=Z)
sph = Sphere(
    Base=Plane(origin=(-45.08093594, 10.62791851, 0), x=(0.9101194735, 0.4143459231, 0), y=(0.3325833422, -0.7305262571, 0.5964224243)),
    Radius=1)
join_2 = JoinCurves(Curves=edges.Naked, Preserve=False)
cone = Cone(
    Base=Plane(origin=(-43.34000472, 3.799767653, 0), x=(0.7179262605, -0.6961191597, 0), y=(-0.6283546093, -0.6480388718, -0.4303674076)),
    Radius=Slider(4, range=0..10),
    Length=Slider(4, range=0..10))  # -> Cone, Tip
area_2 = Area(Geometry=join_2)  # -> Area, Centroid
cls = Closed(Curve=join_2)  # -> Closed, Periodic
crv_3 = Curve(join_2)
mesh = Mesh(cone.Cone)
panel_6 = Panel(cls.Closed)
simplify = SimplifyCurve(Curve=crv_3)  # -> Curve, Simplified
mesh_2 = Mesh(sph)
panel_7 = Panel(area_2.Area)
mesh_3 = Mesh([extr, mesh])
flip = FlipCurve(Curve=simplify.Curve)  # -> Curve, Flag
mesh_4 = Mesh(simplify(graft([mesh_3, mesh_2])))
context_bake = ContextBake(Geometry=mesh_4)
raumhöhe_2 = Slider(2.904, range=2.5..4)
panel_8 = Panel(mesh_4)
switch_holz_stein = BooleanToggle(False)
# Switch bei unter 10° Neigung?
switch_flach_walmdach = BooleanToggle(True)
num = Number(raumhöhe_2)
dispatch = Dispatch(List=flip.Curve, DispatchPattern=switch_holz_stein)  # -> ListA, ListB
panel_9 = Panel("Kurve Original Grundriss")
crv_4 = Curve(flip.Curve)
Z_2 = UnitZ(Factor=1)
debrep = DeconstructBrep(Brep=crv_4)  # -> Faces, Edges, Vertices
md_slider = MDSlider(SliderMode=0, slider_value=Point(0.5, 0.5, 0.5), x_domain=Domain(0, 1), y_domain=Domain(0, 1), z_domain=Domain(0, 1))
extr_2 = Extrude(Base=debrep.Edges, Direction=Z_2)
evalsrf = EvaluateSurface(Surface=reparameterize(extr_2), Point=md_slider)  # -> Point, Normal, UDirection, VDirection, Frame
xy = XYPlane(Origin=Point(0, 0, 0))
Y = UnitY(Factor=1)
panel_10 = Panel("Text Raumname")
angle = Angle(VectorA=evalsrf.Normal, VectorB=Y, Plane=xy)  # -> Angle, Reflex
txt = Text(magnetizing_fpg.RoomNames)
panel_11 = Panel("Brep Räume")
deg = Degrees(Radians=angle.Angle)
tmatch = MatchText(Text=txt, Pattern="Schlafraum", Case=True)
tmatch_2 = MatchText(Text=txt, Pattern="Bad", Case=True)
brep_3 = Brep(magnetizing_fpg.RoomBreps)
panel_13 = Panel("Eingangspunkt")
cull = CullPattern(List=brep_3, CullPattern=tmatch)
cull_2 = CullPattern(List=brep_3, CullPattern=tmatch_2)
crv_5 = Curve(flip.Curve)

# ---- group: Osten
smaller = SmallerThan(FirstNumber=deg, SecondNumber="135")  # -> SmallerThan, OrEqualTo
larger = LargerThan(FirstNumber=deg, SecondNumber="45")  # -> LargerThan, OrEqualTo
and = GateAnd(A=larger.LargerThan, B=smaller.OrEqualTo)
dispatch_2 = Dispatch(List=debrep.Edges, DispatchPattern=and)  # -> ListA, ListB
data = Data(dispatch_2.ListA)

# ----
pt_2 = Point(pt)

# ---- group: Westen
larger_2 = LargerThan(FirstNumber=deg, SecondNumber="225")  # -> LargerThan, OrEqualTo
smaller_2 = SmallerThan(FirstNumber=deg, SecondNumber="315")  # -> SmallerThan, OrEqualTo
and_2 = GateAnd(A=larger_2.LargerThan, B=smaller_2.OrEqualTo)
dispatch_3 = Dispatch(List=debrep.Edges, DispatchPattern=and_2)  # -> ListA, ListB
data_2 = Data(dispatch_3.ListA)

# ---- group: Süden
larger_3 = LargerThan(FirstNumber=deg, SecondNumber="135")  # -> LargerThan, OrEqualTo
smaller_3 = SmallerThan(FirstNumber=deg, SecondNumber="225")  # -> SmallerThan, OrEqualTo
and_3 = GateAnd(A=larger_3.LargerThan, B=smaller_3.OrEqualTo)
dispatch_4 = Dispatch(List=debrep.Edges, DispatchPattern=and_3)  # -> ListA, ListB
data_3 = Data(dispatch_4.ListA)

# ----
merge = Merge(Data1=cull, Data2=cull_2)

# ---- group: Norden
smaller_4 = SmallerThan(FirstNumber=deg, SecondNumber="45")  # -> SmallerThan, OrEqualTo
larger_4 = LargerThan(FirstNumber=deg, SecondNumber="315")  # -> LargerThan, OrEqualTo
or = GateOr(A=smaller_4.OrEqualTo, B=larger_4.LargerThan)
dispatch_5 = Dispatch(List=debrep.Edges, DispatchPattern=or)  # -> ListA, ListB
data_4 = Data(dispatch_5.ListA)

# ----
debrep_2 = DeconstructBrep(Brep=crv_5)  # -> Faces, Edges, Vertices
edges_2 = BrepEdges(Brep=merge)  # -> Naked, Interior, NonManifold
join_3 = JoinCurves(Curves=edges_2.Naked, Preserve=False)
breite_tür_und_rahmen = Number(Slider(2, range=0..2))
simplify_2 = SimplifyCurve(Curve=join_3)  # -> Curve, Simplified
crv_6 = Curve(simplify_2.Curve)
explode = Explode(Curve=crv_6, Recursive=True)  # -> Segments, Vertices
panel_14 = Panel("Grundriss Kurve")
midpt = CurveMiddle(Curve=explode.Segments)
crv_7 = Curve(simplify.Curve)
crv_cp = CurveClosestPoint(Point=midpt, Curve=crv_7)  # -> Point, Parameter, Distance
larger_5 = LargerThan(FirstNumber=crv_cp.Distance, SecondNumber="0.01")  # -> LargerThan, OrEqualTo
wwr_ost = Slider(0.2, range=0..1)
wwr_nord = Slider(0.1, range=0..1)
wwr_süd = Slider(0.4, range=0..1)
wwr_west = Slider(0.2, range=0..1)
cull_3 = CullPattern(List=explode.Segments, CullPattern=larger_5.LargerThan)
wo_tür = Slider(0.5, range=0..1)
end = EndPoints(Curve=cull_3)  # -> Start, End
Z_3 = UnitZ(Factor=1)
crv_8 = Curve(cull_3)
# Weiterleitung an Fenster Cut
pt_3 = Point([end.Start, end.End])
md_slider_2 = MDSlider(SliderMode=0, slider_value=Point(0.5, 0.5, 0.5), x_domain=Domain(0, 1), y_domain=Domain(0, 1), z_domain=Domain(0, 1))
bang = ExplodeTree(Data=crv_8)  # -> _00000, _00100
midpt_2 = CurveMiddle(Curve=crv_8)  # -> graft(Midpoint)
breite_tür = Slider(1, range=0..1)
höhe_tür = Slider(2, range=0..2)
bang_2 = ExplodeTree(Data=crv_8)  # -> _00000, _00100
crv_cp_2 = CurveClosestPoint(Point=midpt_2, Curve=bang._00000)  # -> Point, Parameter, Distance
crv_cp_3 = CurveClosestPoint(Point=midpt_2, Curve=bang_2._00100)  # -> Point, Parameter, Distance
frame_preview_color = ColourSwatch(SwatchColor=RGB(82, 82, 82))
frame_preview_color_2 = ColourSwatch(SwatchColor=RGB(82, 82, 82))
frame_preview_color_3 = ColourSwatch(SwatchColor=RGB(82, 82, 82))
frame_preview_color_4 = ColourSwatch(SwatchColor=RGB(82, 82, 82))
bnd = Bounds(Numbers=crv_cp_2.Distance)
bnd_2 = Bounds(Numbers=crv_cp_3.Distance)
multiplication = Multiplication(A=breite_tür, B="-0.5")
dedomain = DeconstructDomain(Domain=bnd)  # -> Start, End
dedomain_2 = DeconstructDomain(Domain=bnd_2)  # -> Start, End
trim = TrimTree(Tree=dedomain.Start, Depth=1)
panel_15 = Panel("Dicke Wandaufbau gesamt")
trim_2 = TrimTree(Tree=dedomain_2.Start, Depth=1)
equals = Equality(FirstNumber=trim, SecondNumber="0")  # -> Equality, Inequality
create_material = CreateMaterial(
    Diffuse=ColourSwatch(SwatchColor=RGB(255, 255, 255)),
    Specular=RGB(255, 255, 255),
    Emission=RGB(0, 0, 0),
    Transparency=Slider(0.8, range=0..1),
    Shine=0)
create_material_2 = CreateMaterial(
    Diffuse=ColourSwatch(SwatchColor=RGB(255, 255, 255)),
    Specular=RGB(255, 255, 255),
    Emission=RGB(0, 0, 0),
    Transparency=Slider(0.8, range=0..1),
    Shine=0)
create_material_3 = CreateMaterial(
    Diffuse=ColourSwatch(SwatchColor=RGB(255, 255, 255)),
    Specular=RGB(255, 255, 255),
    Emission=RGB(0, 0, 0),
    Transparency=Slider(0.8, range=0..1),
    Shine=0)
create_material_4 = CreateMaterial(
    Diffuse=ColourSwatch(SwatchColor=RGB(255, 255, 255)),
    Specular=RGB(255, 255, 255),
    Emission=RGB(0, 0, 0),
    Transparency=Slider(0.8, range=0..1),
    Shine=0)
equals_2 = Equality(FirstNumber=trim_2, SecondNumber="0")  # -> Equality, Inequality
cull_4 = CullPattern(List=crv_8, CullPattern=equals.Inequality)
cull_5 = CullPattern(List=crv_8, CullPattern=equals_2.Inequality)
panel_17 = Panel("Türhöhe")
num_2 = Number(höhe_tür)
equals_3 = Equality(FirstNumber=[cull_5, cull_4], SecondNumber=crv_8)  # -> Equality, Inequality
Z_4 = UnitZ(Factor=num_2)
cull_6 = CullPattern(List=crv_8, CullPattern=equals_3.Inequality)
panel_18 = Panel("Innere Ecken Oben")
panel_19 = Panel("Innere Ecken Unten")
len = Length(Curve=flatten(cull_6))
bnd_3 = Bounds(Numbers=len)
panel_20 = Panel("Äußere Ecken Oben")
panel_21 = Panel("Äußere Ecken Unten")
dedomain_3 = DeconstructDomain(Domain=bnd_3)  # -> Start, End
equals_4 = Equality(FirstNumber=dedomain_3.End, SecondNumber=cull_6)  # -> Equality, graft(Inequality)
cull_7 = CullPattern(List=cull_6, CullPattern=equals_4.Inequality)
merge_2 = Merge(Data1=cull_5, Data2=cull_4, Data3=cull_7)
panel_22 = Panel("Tangente Vektor")
panel_23 = Panel("Unten")
panel_24 = Panel("Oben")
panel_25 = Panel("1")
panel_26 = Panel("2")
panel_27 = Panel("Dicke Fußplatte")
crv_9 = Curve(merge_2)
dicke_rahmen = Slider(0.05, range=0..0.1)
join_4 = JoinCurves(Curves=merge_2, Preserve=False)
multiplication_2 = Multiplication(B="10")
panel_29 = Panel("Raumhöhe")
number_slider = Slider(0.01, range=0..0.01)
len_2 = Length(Curve=crv_9)
breite_tür_und_rahmen_2 = Number(Slider(0.9, range=0..2))
Z_5 = UnitZ(Factor=multiplication_2)
larger_6 = LargerThan(FirstNumber=len_2, SecondNumber=breite_tür_und_rahmen_2)  # -> LargerThan, OrEqualTo
panel_30 = Panel("Logik Dachform Wechsel")
panel_31 = Panel("Unten-> Walmdach")
dispatch_6 = Dispatch(List=Z_5, DispatchPattern=switch_flach_walmdach)  # -> ListA, ListB
Z_6 = UnitZ(Factor=number_slider)
neg = Negative(Value=dicke_rahmen)
frame_preview_color_5 = ColourSwatch(SwatchColor=RGB(168, 168, 168))
panel_33 = Panel("Oben -> Flachdach")
panel_34 = Panel("Dicke Rahmen")
cull_8 = CullPattern(List=crv_9, CullPattern=larger_6.LargerThan)
number_slider_2 = Slider(0.1, range=0..0.1)

# ---- group: Türplatzierung ohne Innenwand
panel_37 = Panel("Dicke Wandaufbau Innenände")
panel_38 = Panel("Punkte Innenwände")
pt_4 = Point(pt_3)
num_3 = Number(number_slider_2)
sph_2 = Sphere(Base=pt_4, Radius=num_3)
trim_3 = TrimWithBreps(Curve=debrep_2.Edges, Brep=flatten(sph_2))  # -> Inside, Outside
crv_10 = Curve(flatten(trim_3.Outside))
panel_39 = Panel(crv_10)

# ----
len_3 = Length(Curve=crv_10)
larger_7 = LargerThan(FirstNumber=len_3, SecondNumber=breite_tür_und_rahmen)  # -> LargerThan, OrEqualTo
cull_9 = CullPattern(List=crv_10, CullPattern=larger_7.LargerThan)
crv_cp_4 = CurveClosestPoint(Point=pt_2, Curve=cull_9)  # -> Point, Parameter, Distance
bnd_4 = Bounds(Numbers=crv_cp_4.Distance)
dedomain_4 = DeconstructDomain(Domain=bnd_4)  # -> Start, End
equals_5 = Equality(FirstNumber=crv_cp_4.Distance, SecondNumber=dedomain_4.Start)  # -> Equality, Inequality
cull_10 = CullPattern(List=cull_9, CullPattern=equals_5.Equality)
extr_3 = Extrude(Base=cull_10, Direction=Z_3)
eval = EvaluateCurve(Curve=reparameterize(cull_10), Parameter=wo_tür)  # -> Point, Tangent, Angle
evalsrf_2 = EvaluateSurface(Surface=reparameterize(extr_3), Point=md_slider_2)  # -> Point, Normal, UDirection, VDirection, Frame
pt_5 = Point(eval.Point)
vec = Vector(eval.Tangent)
pl = ConstructPlane(Origin=pt_5, XAxis=vec, YAxis=evalsrf_2.Normal)
multiplication_3 = Multiplication(A=vec, B=multiplication)
vec_2 = Vector(evalsrf_2.Normal)
pt_6 = Point(pt_5)
vec_3 = Vector(vec)
multiplication_4 = Multiplication(A=vec_3, B="0.5")
multiplication_5 = Multiplication(A=vec_3, B="-0.5")
move = Move(Geometry=pt_6, Motion=multiplication_4)  # -> Geometry, Transform
move_2 = Move(Geometry=pt_6, Motion=multiplication_5)  # -> Geometry, Transform
move_3 = Move(Geometry=move_2.Geometry, Motion=Z_4)  # -> Geometry, Transform
move_4 = Move(Geometry=move.Geometry, Motion=Z_4)  # -> Geometry, Transform
vec_4 = Vector(vec)
move_5 = Move(Geometry=move_2.Geometry, Motion=Z_6)  # -> Geometry, Transform
move_6 = Move(Geometry=move.Geometry, Motion=Z_6)  # -> Geometry, Transform
multiplication_6 = Multiplication(A=vec_4, B=dicke_rahmen)
vec_5 = Vector(multiplication_6)
rev = Reverse(Vector=vec_5)
num_4 = Number(number_slider)
num_5 = Number(dicke_rahmen)
extr_4 = Extrude(Base=join_4, Direction=dispatch_6.ListB)
frame_preview_color_6 = ColourSwatch(SwatchColor=RGB(82, 82, 82))
move_7 = Move(Geometry=move_6.Geometry, Motion=rev)  # -> Geometry, Transform
move_8 = Move(Geometry=move_5.Geometry, Motion=vec_5)  # -> Geometry, Transform
num_6 = Number(höhe_tür)
clean = CleanTree(RemoveNulls=True, RemoveInvalid=True, RemoveEmpty=Toggle(True), Tree=cull_8)
addition = Addition(A=num_4, B=num_5)
subtraction = Subtraction(A=num_6, B=addition)
offsetbrep = OffsetBrep(Brep=extr_4, OffsetDistance=number_slider_2, Solid=Toggle(True), SharpEdges=True, Tolerance=0.01)
Z_7 = UnitZ(Factor=1)
panel_40 = Panel("Türblatt Grundform")
höhe_tür_2 = Slider(2, range=0..2)
breite_tür_2 = Slider(0.8, range=0..1)
extr_5 = Extrude(Base=clean, Direction=Z_7)
md_slider_3 = MDSlider(SliderMode=0, slider_value=Point(0.5, 0.5, 0.5), x_domain=Domain(0, 1), y_domain=Domain(0, 1), z_domain=Domain(0, 1))
join_5 = BrepJoin(Breps=flatten(offsetbrep))  # -> Breps, Closed
eval_2 = EvaluateCurve(Curve=reparameterize(clean), Parameter="0.5")  # -> Point, Tangent, Angle
panel_41 = Panel("Dach Brep")
Z_8 = UnitZ(Factor=subtraction)
evalsrf_3 = EvaluateSurface(Surface=reparameterize(extr_5), Point=md_slider_3)  # -> Point, Normal, UDirection, VDirection, Frame
pt_7 = Point(eval_2.Point)
vec_6 = Vector(eval_2.Tangent)
move_9 = Move(Geometry=move_8.Geometry, Motion=Z_8)  # -> Geometry, Transform
move_10 = Move(Geometry=move_7.Geometry, Motion=Z_8)  # -> Geometry, Transform
pline = PolyLine(Vertices=[move_8.Geometry, move_7.Geometry, move_10.Geometry, move_9.Geometry], Closed=Toggle(True))
fpatch = FragmentPatch(Boundary=pline)
multiplication_7 = Multiplication(A=breite_tür_2, B="-0.5")
pl_2 = ConstructPlane(Origin=pt_7, XAxis=vec_6, YAxis=evalsrf_3.Normal)
panel_43 = Panel("Normal Vektor Wand")
panel_44 = Panel("Dicke Innenwand")
vec_7 = Vector(evalsrf_2.Normal)
multiplication_8 = Multiplication(A=vec_6, B=multiplication_7)
num_7 = Number(number_slider_2)
rectangle = Rectangle(Plane=pl_2, XSize=breite_tür_2, YSize=num_7, Radius=0)  # -> Rectangle, Length
move_11 = Move(Geometry=rectangle.Rectangle, Motion=multiplication_8)  # -> Geometry, Transform
md_slider_4 = MDSlider(
    SliderMode=0,
    slider_value=Point(0.4426410044, 0.2189917471, 0.5),
    x_domain=Domain(0, 1),
    y_domain=Domain(0, 1),
    z_domain=Domain(0, 1))
boxrec = BoxRectangle(Rectangle=move_11.Geometry, Height=höhe_tür_2)  # -> flatten(Box)
number_slider_3 = Slider(0.02, range=0..0.1)
frame_preview_color_7 = ColourSwatch(SwatchColor=RGB(196, 86, 18))
frame_preview_color_8 = ColourSwatch(SwatchColor=RGB(219, 77, 77))
neg_2 = Negative(Value=number_slider_3)
frame_preview_color_9 = ColourSwatch(SwatchColor=RGB(82, 82, 82))
dicke_diffusionsoffene_schicht = Slider(0.011, range=0.011..0.02)
dicke_zweite_dämmschicht = Slider(0.1, range=0..0.25)
dicke_latte_luftschicht = Slider(0.05, range=0..0.8)
dicke_osb = Slider(0.02, range=0.01..0.02)
dicke_gipskarton = Slider(0.02, range=0.01..0.02)
dicke_innenputz = Slider(0.02, range=0..0.02)
y_holzständer = Slider(0.2, range=0..0.8)
x_holzständer = Slider(0.06, range=0..0.5)
grundriss = Curve(dispatch.ListA)
raumhöhe_3 = Number(num)
num_8 = Number(raumhöhe_3)
Z_9 = UnitZ(Factor=num_8)
dispatch_7 = Dispatch(List=Z_9, DispatchPattern=switch_flach_walmdach)  # -> ListA, ListB
extr_6 = Extrude(Base=join_4, Direction=dispatch_7.ListA)
offsetbrep_2 = OffsetBrep(Brep=extr_6, OffsetDistance=Slider(0.1, range=0..0.1), Solid=Toggle(True), SharpEdges=True, Tolerance=0.01)
join_6 = BrepJoin(Breps=flatten(offsetbrep_2))  # -> Breps, Closed
# Dach Brep Unterseite
# Verteilung
panel_45 = Panel("""Raumhöhe
Verteilung""")
dicke_innenputz_2 = Slider(0.02, range=0..0.02)
dicke_abdichtung = Slider(0.011, range=0.011..0.02)
dicke_außenputz = Slider(0.02, range=0.01..0.02)
dicke_wand = Slider(0.2, range=0.1..0.4)
dicke_dämmung = Slider(0.35, range=0.1..0.5)
panel_46 = Panel("Dach Brep Unterseite")
raumhöhe_4 = Number(num)
# Raumhöhe x 10 um Cutoff zu generieren
num_9 = Number(raumhöhe_4)
crv_11 = Curve(dispatch.ListB)
dicke_innenputz_3 = Number(dicke_innenputz)
dicke_latte_luftschicht_2 = Number(dicke_latte_luftschicht)
dicke_diffusionsoffene_schicht_2 = Number(dicke_diffusionsoffene_schicht)
dicke_zweite_dämmschicht_2 = Number(dicke_zweite_dämmschicht)
dicke_gk = Number(dicke_gipskarton)
dicke_wand_2 = Number(y_holzständer)
num_10 = Number(x_holzständer)
dicke_osb_2 = Number(dicke_osb)

# ---- group: Logik Wanddicken
# Boolean Switch Holz Stein
# Boolean Switch Holz Stein
# Boolean Switch Holz Stein
# Boolean Switch Holz Stein
# Dicke zweite Dämmschicht Holz
# Boolean Switch Holz Stein
# Boolean Switch Holz Stein
# Dicke OSB + GK Holz
panel_47 = Panel("0")
panel_48 = Panel("Dicke Putz Massiv")
panel_49 = Panel("Dicke Abdichtung Massiv")
panel_50 = Panel("Dicke Diffusionsof. S. Holz")
panel_51 = Panel("Dicke Dämmschicht Massiv")
panel_52 = Panel("Dicke Luftschicht Massiv")
panel_53 = Panel("Dicke Luftschicht Holz")
panel_54 = Panel("Dicke Wand Massiv")
panel_55 = Panel("Dicke Holständer Holz")
panel_57 = Panel("Dicke Putz Holz")
data_5 = Data(dicke_außenputz)
data_6 = Data(dicke_osb_2)
data_7 = Data(dicke_gk)
addition_2 = Addition(A=data_6, B=data_7)
panel_58 = Panel("Dicke Wand Tragend")
panel_59 = Panel("Dicke Putz")
panel_60 = Panel("Dicke Abdichtung")
panel_61 = Panel("Dicke Aüßere Dämmschicht")
bool = Boolean(switch_holz_stein)
bool_2 = Boolean(switch_holz_stein)
data_8 = Data(dicke_wand)
bool_3 = Boolean(switch_holz_stein)
panel_62 = Panel("Dicke Luftschicht")
data_9 = Data(dicke_innenputz_2)
data_10 = Data(dicke_abdichtung)
data_11 = Data(dicke_wand_2)
data_12 = Data(dicke_innenputz_3)
data_13 = Data(dicke_diffusionsoffene_schicht_2)
bool_4 = Boolean(switch_holz_stein)
data_14 = Data(dicke_dämmung)
data_15 = Data(dicke_zweite_dämmschicht_2)
bool_5 = Boolean(switch_holz_stein)
data_16 = Data(panel_47)
data_17 = Data(dicke_latte_luftschicht_2)
panel_63 = Panel("Dicke Außenhaut")
panel_64 = Panel("Dicke Wandaufbau Gesamt")
bool_6 = Boolean(switch_holz_stein)
p_n_c = PickNChoose(Pattern=bool_2, Stream0=data_9, Stream1=data_12)
p_n_c_2 = PickNChoose(Pattern=bool, Stream0=data_8, Stream1=data_11)
p_n_c_3 = PickNChoose(Pattern=bool_3, Stream0=data_10, Stream1=data_13)
p_n_c_4 = PickNChoose(Pattern=bool_4, Stream0=data_14, Stream1=data_15)
p_n_c_5 = PickNChoose(Pattern=bool_5, Stream0=data_16, Stream1=data_17)
p_n_c_6 = PickNChoose(Pattern=bool_6, Stream0=data_5, Stream1=addition_2)
data_18 = Data(p_n_c)
data_19 = Data(p_n_c_2)
data_20 = Data(p_n_c_3)
data_21 = Data(p_n_c_4)
data_22 = Data(p_n_c_5)
data_23 = Data(p_n_c_6)
ma = MassAddition(Input=[data_23, data_22, data_21, data_20, data_19, data_18])  # -> Result, PartialResults
data_24 = Data(ma.Result)

# ----
num_11 = Number(data_24)
rectangle_2 = Rectangle(Plane=pl, XSize=breite_tür, YSize=num_11, Radius=0)  # -> Rectangle, Length
move_12 = Move(Geometry=rectangle_2.Rectangle, Motion=multiplication_3)  # -> Geometry, Transform
num_12 = Number(num_11)
multiplication_9 = Multiplication(A=vec_2, B=num_12)
boxrec_2 = BoxRectangle(Rectangle=move_12.Geometry, Height=höhe_tür)
# Daten für Trim "Wo ist Tür"
data_25 = Data(boxrec_2)
trim_4 = TrimWithBreps(Curve=data, Brep=data_25)  # -> Inside, Outside
trim_5 = TrimWithBreps(Curve=data_4, Brep=data_25)  # -> Inside, Outside
trim_6 = TrimWithBreps(Curve=data_3, Brep=data_25)  # -> Inside, Outside
trim_7 = TrimWithBreps(Curve=data_2, Brep=data_25)  # -> Inside, Outside
crv_12 = Curve(trim_5.Outside)
crv_13 = Curve(trim_4.Outside)
crv_14 = Curve(trim_6.Outside)
crv_15 = Curve(trim_7.Outside)
fenster_generator = FensterGenerator(
    num_5=num,
    wwr_himmelsrichtung=wwr_nord,
    kurven_himmelsrichtung=crv_12,
    num=num_11,
    pt=pt_3,
    num_2=number_slider_2,
    num_10=data_24)  # -> G, output_glas_2, output_fensterrahmen_2, B
fenster_generator_2 = FensterGenerator(
    num_5=num,
    wwr_himmelsrichtung=wwr_ost,
    kurven_himmelsrichtung=crv_13,
    num=num_11,
    pt=pt_3,
    num_2=number_slider_2,
    num_10=data_24)  # -> G, output_glas_2, output_fensterrahmen_2, B
fenster_generator_3 = FensterGenerator(
    num_5=num,
    wwr_himmelsrichtung=wwr_süd,
    kurven_himmelsrichtung=crv_14,
    num=num_11,
    pt=pt_3,
    num_2=number_slider_2,
    num_10=data_24)  # -> G, output_glas_2, output_fensterrahmen_2, B
fenster_generator_4 = FensterGenerator(
    num_5=num,
    wwr_himmelsrichtung=wwr_west,
    kurven_himmelsrichtung=crv_15,
    num=num_11,
    pt=pt_3,
    num_2=number_slider_2,
    num_10=data_24)  # -> G, output_glas_2, output_fensterrahmen_2, B
preview = CustomPreview(Geometry=fenster_generator.output_fensterrahmen_2, Material=frame_preview_color_2)
preview_2 = CustomPreview(Geometry=fenster_generator_2.output_fensterrahmen_2, Material=frame_preview_color)
preview_3 = CustomPreview(Geometry=fenster_generator_3.output_fensterrahmen_2, Material=frame_preview_color_3)
preview_4 = CustomPreview(Geometry=fenster_generator_4.output_fensterrahmen_2, Material=frame_preview_color_4)
custom_preview = CustomPreview(Geometry=fenster_generator.output_glas_2, Material=create_material)
custom_preview_2 = CustomPreview(Geometry=fenster_generator_2.output_glas_2, Material=create_material_2)
custom_preview_3 = CustomPreview(Geometry=fenster_generator_3.output_glas_2, Material=create_material_3)
custom_preview_4 = CustomPreview(Geometry=fenster_generator_4.output_glas_2, Material=create_material_4)
move_13 = Move(Geometry=move.Geometry, Motion=multiplication_9)  # -> Geometry, Transform
move_14 = Move(Geometry=move_13.Geometry, Motion=Z_4)  # -> Geometry, Transform
move_15 = Move(Geometry=move_2.Geometry, Motion=multiplication_9)  # -> Geometry, Transform
move_16 = Move(Geometry=move_15.Geometry, Motion=Z_4)  # -> Geometry, Transform
pline_2 = PolyLine(Vertices=[move_3.Geometry, move_4.Geometry, move_14.Geometry, move_16.Geometry], Closed=Toggle(True))
pline_3 = PolyLine(Vertices=[move.Geometry, move_2.Geometry, move_15.Geometry, move_13.Geometry], Closed=Toggle(True))
pline_4 = PolyLine(Vertices=[move.Geometry, move_13.Geometry, move_14.Geometry, move_4.Geometry], Closed=Toggle(True))
pline_5 = PolyLine(Vertices=[move_15.Geometry, move_2.Geometry, move_3.Geometry, move_16.Geometry], Closed=Toggle(True))
fpatch_2 = FragmentPatch(Boundary=pline_2)
fpatch_3 = FragmentPatch(Boundary=pline_3)
fpatch_4 = FragmentPatch(Boundary=pline_4)
fpatch_5 = FragmentPatch(Boundary=pline_5)
join_7 = BrepJoin(Breps=[fpatch_2, fpatch_4, fpatch_5])  # -> Breps, Closed
offsetbrep_3 = OffsetBrep(Brep=join_7.Breps, OffsetDistance=neg, Solid=Toggle(True), SharpEdges=True, Tolerance=0.01)
extr_7 = Extrude(Base=fpatch_3, Direction=Z_6)
preview_5 = CustomPreview(Geometry=extr_7, Material=frame_preview_color_5)
preview_6 = CustomPreview(Geometry=offsetbrep_3, Material=frame_preview_color_6)
num_13 = Number(num_11)
multiplication_10 = Multiplication(A=num_13, B=Slider(0.7, range=0..1))
multiplication_11 = Multiplication(A=vec_7, B=multiplication_10)
move_17 = Move(Geometry=fpatch, Motion=multiplication_11)  # -> Geometry, Transform
evalsrf_4 = EvaluateSurface(Surface=reparameterize(move_17.Geometry), Point=md_slider_4)  # -> Point, Normal, UDirection, VDirection, Frame
offsrf = OffsetSurface(Surface=move_17.Geometry, Distance=Slider(0.04, range=0..0.1), BothSides=0, CreateSolid=True)
pl_3 = ConstructPlane(Origin=evalsrf_4.Point, XAxis=evalsrf_4.VDirection, YAxis=evalsrf_4.UDirection)
preview_7 = CustomPreview(Geometry=offsrf, Material=frame_preview_color_7)
cyl = Cylinder(Base=pl_3, Radius=number_slider_3, Length=number_slider_3)
multiplication_12 = Multiplication(A=evalsrf_4.Normal, B=neg_2)
move_18 = Move(Geometry=evalsrf_4.Point, Motion=multiplication_12)  # -> Geometry, Transform
sph_3 = Sphere(Base=move_18.Geometry, Radius=number_slider_3)
preview_8 = CustomPreview(Geometry=[cyl, sph_3], Material=frame_preview_color_9)
# Daten für Abzug Wand
data_26 = Data(flatten([boxrec_2, fenster_generator_3.B, fenster_generator.B, fenster_generator_2.B, fenster_generator_4.B]))
panel_65 = Panel("Kurve Dämmung")
panel_66 = Panel("""Kurve Dämmung
Hochgeschoben Ringbalken""")
# Grundriss nach Zweiter Dämmschicht
panel_67 = Panel("Dicke Latte Luftschicht")
höhe_ringbalken_unten = Slider(0.2, range=0..1)
panel_68 = Panel("Ringbalken Holz unten")
panel_70 = Panel("Grundriss Ganz innen")
# Raumhöhe x 10 um Cutoff zu generieren
num_14 = Number(raumhöhe_4)
panel_72 = Panel("Grundriss nach Dämmung")
panel_73 = Panel("Grundriss nach Abdichtung")
panel_75 = Panel("Grundriss nach OSB")
panel_76 = Panel("Y Holzständer")
num_15 = Number(dicke_latte_luftschicht_2)
multiplication_13 = Multiplication(B="10")
panel_77 = Panel("Dicke Innenputz")
# Grundriss nach tragender Wand
# Raumhöhe x 10 um Cutoff zu generieren
panel_78 = Panel("Dicke Diff Schicht")
num_16 = Number(raumhöhe_4)
crv_16 = Curve(grundriss)
crv_17 = Curve(crv_11)
# Raumhöhe x 10 um Cutoff zu generieren
num_17 = Number(raumhöhe_4)
# Raumhöhe x 10 um Cutoff zu generieren
panel_80 = Panel("Dicke Außenputz")
num_18 = Number(raumhöhe_4)
# Raumhöhe x 10 um Cutoff zu generieren
panel_81 = Panel("Dicke Zweite Dämmschicht")
# Raumhöhe x 10 um Cutoff zu generieren
panel_82 = Panel("Dicke Dämmung")
# Raumhöhe x 10 um Cutoff zu generieren
panel_83 = Panel("Dicke OSB")
# Grundriss nach tragender Wand
# Raumhöhe x 10 um Cutoff zu generieren
panel_84 = Panel("Dicke Abdichtung")
num_19 = Number(raumhöhe_4)
Z_10 = UnitZ(Factor=multiplication_13)
Z_11 = UnitZ(Factor=num_16)
num_20 = Number(raumhöhe_4)
Z_12 = UnitZ(Factor=1)
panel_85 = Panel("Innenputz")
multiplication_14 = Multiplication(B="10")
panel_86 = Panel("Abdichtung")
num_21 = Number(raumhöhe_4)
Z_13 = UnitZ(Factor=1)
num_22 = Number(raumhöhe_4)
offset = OffsetCurve(Curve=crv_16, Distance=dicke_innenputz_3, Corners=1)
edges_3 = BrepEdges(Brep=offset)  # -> Naked, Interior, NonManifold
len_4 = Length(Curve=edges_3.Naked)
crv_18 = Curve(offset)
divide = DivideCurve(Curve=edges_3.Naked, Count=len_4, Kinks=False)  # -> Points, Tangents, Parameters
offset_2 = OffsetCurve(Curve=crv_18, Distance=dicke_wand_2, Corners=1)
crv_19 = Curve(offset_2)
panel_88 = Panel("Kurve OSB")
offset_3 = OffsetCurve(Curve=crv_19, Distance=dicke_diffusionsoffene_schicht_2, Corners=1)
crv_20 = Curve(offset_3)
offset_4 = OffsetCurve(Curve=crv_17, Distance=dicke_innenputz_2, Corners=1)
multiplication_15 = Multiplication(B="10")
num_23 = Number(raumhöhe_4)
panel_89 = Panel("Außenputz")
panel_90 = Panel("Zweite Dämmschicht")
multiplication_16 = Multiplication(B="10")
panel_92 = Panel("Grundriss nach Inneputz")
dicke_fußbodendämmung = Slider(0.12, range=0.12..0.25)
panel_94 = Panel("Dämmung")
offset_5 = OffsetCurve(Curve=crv_20, Distance=dicke_zweite_dämmschicht_2, Corners=1)
crv_21 = Curve(offset_5)
offset_6 = OffsetCurve(Curve=crv_21, Distance=num_15, Corners=1)
multiplication_17 = Multiplication(B="10")
multiplication_18 = Multiplication(B="10")
multiplication_19 = Multiplication(B="10")
dispatch_8 = Dispatch(List=Z_10, DispatchPattern=switch_flach_walmdach)  # -> ListA, ListB
dispatch_9 = Dispatch(List=Z_11, DispatchPattern=switch_flach_walmdach)  # -> ListA, ListB
# Randkure Innenputz
# für Bodenbelag beginn
dicke_bodenbelag = Slider(0.05, range=0..0.1)
multiplication_20 = Multiplication(B="10")
dicke_estrich = Slider(0.08, range=0.025..0.1)
num_24 = Number(raumhöhe_4)
dicke_dampfsperre = Slider(0.01, range=0.005..0.01)
dicke_bodenplatte = Slider(0.3, range=0.25..0.5)
edges_4 = BrepEdges(Brep=offset_6)  # -> Naked, Interior, NonManifold
boundary = BoundarySurfaces(Edges=flatten([crv_18, offset_2]))
num_25 = Number(raumhöhe_4)
Z_14 = UnitZ(Factor=multiplication_15)
boundary_2 = BoundarySurfaces(Edges=flatten([crv_16, offset]))
boundary_3 = BoundarySurfaces(Edges=flatten([crv_19, offset_3]))
boundary_4 = BoundarySurfaces(Edges=flatten([crv_17, offset_4]))
num_26 = Number(raumhöhe_4)
Z_15 = UnitZ(Factor=multiplication_16)
Z_16 = UnitZ(Factor=höhe_ringbalken_unten)
Z_17 = UnitZ(Factor=multiplication_14)
Z_18 = UnitZ(Factor=multiplication_17)
Z_19 = UnitZ(Factor=multiplication_18)
# Raumhöhe x 10 um Cutoff zu generieren
panel_102 = Panel("Dicke Wand")
panel_103 = Panel("Dicke OSB")
Z_20 = UnitZ(Factor=multiplication_20)
Z_21 = UnitZ(Factor=num_24)
boundary_5 = BoundarySurfaces(Edges=flatten([crv_20, offset_5]))
crv_22 = Curve(offset_4)
# Grundriss vor tragender Wand
edges_5 = BrepEdges(Brep=crv_22)  # -> Naked, Interior, NonManifold
midpt_3 = CurveMiddle(Curve=edges_5.Naked)
line = LineSDL(Start=midpt_3, Direction=Z_12, Length=Slider(100000000, range=0..100000000))
Z_22 = UnitZ(Factor=raumhöhe_3)
Z_23 = UnitZ(Factor=multiplication_19)
Z_24 = UnitZ(Factor=num_25)
crv_23 = Curve(offset)
Z_25 = UnitZ(Factor=num_26)
# Raumhöhe x 10 um Cutoff zu generieren
num_27 = Number(raumhöhe_4)
item = ListItem(List=divide.Points, Index="0", Wrap=True)
dispatch_10 = Dispatch(List=Z_14, DispatchPattern=switch_flach_walmdach)  # -> ListA, ListB
num_28 = Number(raumhöhe_4)
panel_107 = Panel("Tragende Wand")
Z_26 = UnitZ(Factor=1)
midpt_4 = CurveMiddle(Curve=edges_4.Naked)
dispatch_11 = Dispatch(List=Z_15, DispatchPattern=switch_flach_walmdach)  # -> ListA, ListB
extr_8 = Extrude(Base=boundary, Direction=Z_16)
dispatch_12 = Dispatch(List=Z_18, DispatchPattern=switch_flach_walmdach)  # -> ListA, ListB
dispatch_13 = Dispatch(List=Z_21, DispatchPattern=switch_flach_walmdach)  # -> ListA, ListB
panel_114 = Panel("Gipskarton")
offset_7 = OffsetCurve(Curve=crv_22, Distance=dicke_wand, Corners=1)
# Grundriss nach tragender Wand
edges_6 = BrepEdges(Brep=offset_7)  # -> Naked, Interior, NonManifold
midpt_5 = CurveMiddle(Curve=edges_6.Naked)
crv_24 = Curve(offset_7)
offset_8 = OffsetCurve(Curve=crv_24, Distance=dicke_abdichtung, Corners=1)
crv_25 = Curve(offset_8)
offset_9 = OffsetCurve(Curve=crv_25, Distance=dicke_dämmung, Corners=1)
crv_26 = Curve(offset_9)
offset_10 = OffsetCurve(Curve=crv_26, Distance=dicke_außenputz, Corners=1)
line_2 = LineSDL(Start=midpt_5, Direction=Z_13, Length=Slider(100000000, range=0..100000000))
boundary_6 = BoundarySurfaces(Edges=flatten([crv_26, offset_10]))
boundary_7 = BoundarySurfaces(Edges=flatten([crv_25, offset_9]))
boundary_8 = BoundarySurfaces(Edges=flatten([crv_24, offset_8]))
item_2 = ListItem(List=divide.Points, Index="0", Wrap=True)
item_3 = ListItem(List=divide.Tangents, Index="0", Wrap=True)
offset_11 = OffsetCurve(Curve=offset_6, Distance=dicke_osb_2, Corners=1)
crv_27 = Curve(offset_11)
offset_12 = OffsetCurve(Curve=crv_27, Distance=dicke_gk, Corners=1)
boundary_9 = BoundarySurfaces(Edges=flatten([crv_27, offset_12]))
multiplication_21 = Multiplication(B="10")
dispatch_14 = Dispatch(List=Z_23, DispatchPattern=switch_flach_walmdach)  # -> ListA, ListB
dispatch_15 = Dispatch(List=Z_19, DispatchPattern=switch_flach_walmdach)  # -> ListA, ListB
multiplication_22 = Multiplication(B="10")
dispatch_16 = Dispatch(List=Z_24, DispatchPattern=switch_flach_walmdach)  # -> ListA, ListB
dispatch_17 = Dispatch(List=Z_20, DispatchPattern=switch_flach_walmdach)  # -> ListA, ListB
dispatch_18 = Dispatch(List=Z_25, DispatchPattern=switch_flach_walmdach)  # -> ListA, ListB
panel_122 = Panel("Breite Latte")
move_19 = Move(Geometry=crv_23, Motion=Z_22)  # -> Geometry, Transform
dist = Distance(PointA=item, PointB=divide.Points)
frame_preview_color_10 = ColourSwatch(SwatchColor=RGB(196, 86, 18))
panel_125 = Panel("Tür Rechteck")
extr_9 = Extrude(Base=boundary_4, Direction=dispatch_8.ListB)
Z_27 = UnitZ(Factor=multiplication_21)
extr_10 = Extrude(Base=boundary_4, Direction=dispatch_9.ListA)
line_3 = LineSDL(Start=midpt_4, Direction=Z_26, Length=Slider(100000000, range=0..100000000))
align = AlignPlane(Plane=item_2, Direction=item_3)  # -> Plane, Angle
boundary_10 = BoundarySurfaces(Edges=flatten([crv_22, offset_7]))
boundary_11 = BoundarySurfaces(Edges=flatten([offset_6, offset_11]))
breite_der_latte = Number(num_10)
bnd_5 = Bounds(Numbers=dist)
fastsdiff = FastSolidDifference(
    SubtractFrom=graft(extr_8),
    SubtractWith=data_26,
    Tolerance=0.01,
    computeBBFastSolidDiff=True,
    retainFastSolidDiff=True,
    strictFastSolidDiff=True,
    trueIntFastSolidDiff=False)
extr_11 = Extrude(Base=boundary_3, Direction=dispatch_10.ListB)
num_29 = Number(raumhöhe_3)
num_30 = Number(raumhöhe_3)
extr_12 = Extrude(Base=boundary_8, Direction=dispatch_15.ListB)
dispatch_19 = Dispatch(List=Z_27, DispatchPattern=switch_flach_walmdach)  # -> ListA, ListB
extr_13 = Extrude(Base=boundary_7, Direction=dispatch_17.ListB)
extr_14 = Extrude(Base=boundary_6, Direction=dispatch_11.ListB)
num_31 = Number(raumhöhe_3)
extr_15 = Extrude(Base=boundary_9, Direction=dispatch_14.ListB)
num_32 = Number(raumhöhe_3)
Z_28 = UnitZ(Factor=num_29)
num_33 = Number(raumhöhe_4)
Z_29 = UnitZ(Factor=num_30)
dedom2num = DeconstructDomain²(Domain=bnd_5)  # -> UMin, UMax, VMin, VMax
extr_16 = Extrude(Base=boundary_5, Direction=dispatch_12.ListB)
extr_17 = Extrude(Base=boundary_6, Direction=dispatch_13.ListA)
preview_9 = CustomPreview(Geometry=fastsdiff, Material=frame_preview_color_10)
Z_30 = UnitZ(Factor=num_31)
Z_31 = UnitZ(Factor=num_32)
fastsdiff_2 = FastSolidDifference(
    SubtractFrom=graft(extr_10),
    SubtractWith=data_26,
    Tolerance=0.01,
    computeBBFastSolidDiff=True,
    retainFastSolidDiff=True,
    strictFastSolidDiff=True,
    trueIntFastSolidDiff=False)
extr_18 = Extrude(Base=boundary_8, Direction=dispatch_16.ListA)
Z_32 = UnitZ(Factor=höhe_ringbalken_unten)
extr_19 = Extrude(Base=boundary_7, Direction=dispatch_18.ListA)
Z_33 = UnitZ(Factor=num_33)
panel_143 = Panel("X Holzständer")
dispatch_20 = Dispatch(List=Z_28, DispatchPattern=switch_flach_walmdach)  # -> ListA, ListB
dispatch_21 = Dispatch(List=Z_17, DispatchPattern=switch_flach_walmdach)  # -> ListA, ListB
dispatch_22 = Dispatch(List=Z_29, DispatchPattern=switch_flach_walmdach)  # -> ListA, ListB
dispatch_23 = Dispatch(List=Z_30, DispatchPattern=switch_flach_walmdach)  # -> ListA, ListB
dispatch_24 = Dispatch(List=Z_31, DispatchPattern=switch_flach_walmdach)  # -> ListA, ListB
subtraction_2 = Subtraction(A=dedom2num.UMax, B=breite_der_latte)
extr_20 = Extrude(Base=boundary_11, Direction=dispatch_19.ListB)
move_20 = Move(Geometry=crv_18, Motion=Z_32)  # -> Geometry, Transform
edges_7 = BrepEdges(Brep=move_20.Geometry)  # -> Naked, Interior, NonManifold
len_5 = Length(Curve=edges_7.Naked)
divide_2 = DivideCurve(Curve=edges_7.Naked, Count=len_5, Kinks=False)  # -> Points, Tangents, Parameters
item_4 = ListItem(List=divide_2.Points, Index="0", Wrap=True)
item_5 = ListItem(List=divide_2.Tangents, Index="0", Wrap=True)
item_6 = ListItem(List=divide_2.Points, Index="0", Wrap=True)
align_2 = AlignPlane(Plane=item_4, Direction=item_5)  # -> Plane, Angle
dist_2 = Distance(PointA=item_6, PointB=divide_2.Points)
bnd_6 = Bounds(Numbers=dist_2)
dispatch_25 = Dispatch(List=Z_33, DispatchPattern=switch_flach_walmdach)  # -> ListA, ListB
num_34 = Number(raumhöhe_3)
dedom2num_2 = DeconstructDomain²(Domain=bnd_6)  # -> UMin, UMax, VMin, VMax
num_35 = Number(num_10)
extr_21 = Extrude(Base=boundary_2, Direction=dispatch_21.ListB)
extr_22 = Extrude(Base=boundary_3, Direction=dispatch_20.ListA)
fastsdiff_3 = FastSolidDifference(
    SubtractFrom=graft(extr_17),
    SubtractWith=data_26,
    Tolerance=0.01,
    computeBBFastSolidDiff=True,
    retainFastSolidDiff=True,
    strictFastSolidDiff=True,
    trueIntFastSolidDiff=False)
panel_161 = Panel("Dicke Latte Luftschicht")
dom = ConstructDomain(DomainStart=0, DomainEnd=subtraction_2)
Z_34 = UnitZ(Factor=1)
Z_35 = UnitZ(Factor=num_34)
Z_36 = UnitZ(Factor=1)
extr_23 = Extrude(Base=boundary_2, Direction=dispatch_22.ListA)
fastsdiff_4 = FastSolidDifference(
    SubtractFrom=graft(extr_18),
    SubtractWith=data_26,
    Tolerance=0.01,
    computeBBFastSolidDiff=True,
    retainFastSolidDiff=True,
    strictFastSolidDiff=True,
    trueIntFastSolidDiff=False)
frame_preview_color_11 = ColourSwatch(SwatchColor=RGB(219, 77, 77))
extr_24 = Extrude(Base=boundary_5, Direction=dispatch_23.ListA)
extr_25 = Extrude(Base=boundary_9, Direction=dispatch_24.ListA)
subtraction_3 = Subtraction(A=dedom2num_2.UMax, B=num_35)
dispatch_26 = Dispatch(List=Z_35, DispatchPattern=switch_flach_walmdach)  # -> ListA, ListB
fastsdiff_5 = FastSolidDifference(
    SubtractFrom=graft(extr_19),
    SubtractWith=data_26,
    Tolerance=0.01,
    computeBBFastSolidDiff=True,
    retainFastSolidDiff=True,
    strictFastSolidDiff=True,
    trueIntFastSolidDiff=False)
Z_37 = UnitZ(Factor=dicke_bodenbelag)
Z_38 = UnitZ(Factor=dicke_estrich)
rectangle_3 = Rectangle(Plane=align.Plane, XSize=breite_der_latte, YSize=dicke_latte_luftschicht, Radius=0)  # -> Rectangle, Length
Z_39 = UnitZ(Factor=dicke_fußbodendämmung)
Z_40 = UnitZ(Factor=dicke_dampfsperre)
Z_41 = UnitZ(Factor=dicke_bodenplatte)
frame_preview_color_12 = ColourSwatch(SwatchColor=RGB(0, 0, 0))
frame_preview_color_13 = ColourSwatch(SwatchColor=RGB(214, 198, 152))
fastsdiff_6 = FastSolidDifference(
    SubtractFrom=graft(extr_22),
    SubtractWith=data_26,
    Tolerance=0.01,
    computeBBFastSolidDiff=True,
    retainFastSolidDiff=True,
    strictFastSolidDiff=True,
    trueIntFastSolidDiff=False)
remap = RemapNumbers(Value=dist, Source=bnd_5, Target=dom)  # -> Mapped, Clipped
crv_28 = Curve(move_20.Geometry)
# Grundriss vor tragender Wand
edges_8 = BrepEdges(Brep=crv_28)  # -> Naked, Interior, NonManifold
midpt_6 = CurveMiddle(Curve=edges_8.Naked)
line_4 = LineSDL(Start=midpt_6, Direction=Z_34, Length=Slider(100000000, range=0..100000000))
# Frostsicheres Fundament mind 80cm
panel_179 = Panel("Dicke Wand")
dom_2 = ConstructDomain(DomainStart=0, DomainEnd=subtraction_3)
neg_3 = Negative(Value=Z_37)
neg_4 = Negative(Value=Z_38)
frame_preview_color_14 = ColourSwatch(SwatchColor=RGB(196, 196, 196))
neg_5 = Negative(Value=Z_39)
neg_6 = Negative(Value=Z_40)
neg_7 = Negative(Value=Z_41)
multiplication_23 = Multiplication(A=remap.Mapped, B=item_3)
frame_preview_color_15 = ColourSwatch(SwatchColor=RGB(0, 0, 0))
ma_2 = MassAddition(Input=[dicke_bodenbelag, dicke_estrich, dicke_fußbodendämmung, dicke_dampfsperre, dicke_bodenplatte])  # -> Result, PartialResults
panel_184 = Panel("Dicke Diffusionsoffene Schicht")
extr_26 = Extrude(Base=boundary_11, Direction=dispatch_26.ListA)
frame_preview_color_16 = ColourSwatch(SwatchColor=RGB(153, 214, 152))
fastsdiff_7 = FastSolidDifference(
    SubtractFrom=graft(extr_25),
    SubtractWith=data_26,
    Tolerance=0.01,
    computeBBFastSolidDiff=True,
    retainFastSolidDiff=True,
    strictFastSolidDiff=True,
    trueIntFastSolidDiff=False)
frame_preview_color_17 = ColourSwatch(SwatchColor=RGB(204, 203, 200))
offset_13 = OffsetCurve(Curve=crv_28, Distance=dicke_wand_2, Corners=1)
# Grundriss nach tragender Wand
edges_9 = BrepEdges(Brep=offset_13)  # -> Naked, Interior, NonManifold
midpt_7 = CurveMiddle(Curve=edges_9.Naked)
line_5 = LineSDL(Start=midpt_7, Direction=Z_36, Length=Slider(100000000, range=0..100000000))
fastsdiff_8 = FastSolidDifference(
    SubtractFrom=graft(extr_23),
    SubtractWith=data_26,
    Tolerance=0.01,
    computeBBFastSolidDiff=True,
    retainFastSolidDiff=True,
    strictFastSolidDiff=True,
    trueIntFastSolidDiff=False)
frame_preview_color_18 = ColourSwatch(SwatchColor=RGB(208, 10, 252))
fastsdiff_9 = FastSolidDifference(
    SubtractFrom=graft(extr_24),
    SubtractWith=data_26,
    Tolerance=0.01,
    computeBBFastSolidDiff=True,
    retainFastSolidDiff=True,
    strictFastSolidDiff=True,
    trueIntFastSolidDiff=False)
move_21 = Move(Geometry=rectangle_3.Rectangle, Motion=multiplication_23)  # -> Geometry, Transform
frame_preview_color_19 = ColourSwatch(SwatchColor=RGB(196, 86, 18))
rad = Radians(Degrees="90")
vec_8 = Vector(divide.Tangents)
rectangle_4 = Rectangle(Plane=align_2.Plane, XSize=num_35, YSize=dicke_wand_2, Radius=0)  # -> Rectangle, Length
remap_2 = RemapNumbers(Value=dist_2, Source=bnd_6, Target=dom_2)  # -> Mapped, Clipped
num_36 = Number(data_19)
boundary_12 = BoundarySurfaces(Edges=flatten([crv_28, offset_13]))
rotate = Rotate(Geometry=vec_8, Angle=rad, Plane=PlaneXY(0, 0, 0))  # -> Geometry, Transform
fastsdiff_10 = FastSolidDifference(
    SubtractFrom=graft(extr_26),
    SubtractWith=data_26,
    Tolerance=0.01,
    computeBBFastSolidDiff=True,
    retainFastSolidDiff=True,
    strictFastSolidDiff=True,
    trueIntFastSolidDiff=False)
frame_preview_color_20 = ColourSwatch(SwatchColor=RGB(214, 198, 152))
frame_preview_color_21 = ColourSwatch(SwatchColor=RGB(219, 77, 77))
addition_3 = Addition(A=dicke_diffusionsoffene_schicht_2, B=dicke_wand_2)
multiplication_24 = Multiplication(A=remap_2.Mapped, B=item_5)
panel_192 = Panel("Höhe Ringbalken Unten")
neg_8 = Negative(Value="0.8")
panel_195 = Panel("Dicke zweite Dämmschicht")
num_37 = Number(raumhöhe_3)
move_22 = Move(Geometry=rectangle_4.Rectangle, Motion=multiplication_24)  # -> Geometry, Transform
panel_197 = Panel("Höhe Attika")
num_38 = Number(raumhöhe_3)
Z_42 = UnitZ(Factor=neg_8)
addition_4 = Addition(A=dicke_zweite_dämmschicht_2, B=addition_3)
subtraction_4 = Subtraction(A=num_37, B=höhe_ringbalken_unten)
num_39 = Number(raumhöhe_3)
subtraction_5 = Subtraction(A=num_38, B=höhe_ringbalken_unten)

# ----
# Summe aus allen Bauteilen nach Wand bilden
num_40 = Number(data_21)
num_41 = Number(data_22)
num_42 = Number(data_20)
num_43 = Number(data_23)

Z_43 = UnitZ(Factor=subtraction_4)
multiplication_25 = Multiplication(A=rotate.Geometry, B=addition_4)
Z_44 = UnitZ(Factor=subtraction_5)
dispatch_27 = Dispatch(List=Z_43, DispatchPattern=switch_flach_walmdach)  # -> ListA, ListB
dispatch_28 = Dispatch(List=Z_44, DispatchPattern=switch_flach_walmdach)  # -> ListA, ListB
subtraction_6 = Subtraction(A="0.8", B=ma_2.Result)
move_23 = Move(Geometry=move_21.Geometry, Motion=multiplication_25)  # -> Geometry, Transform
extr_27 = Extrude(Base=boundary_12, Direction=dispatch_27.ListA)
ma_3 = MassAddition(Input=[num_42, num_40, num_41, num_43])  # -> Result, PartialResults
frame_preview_color_22 = ColourSwatch(SwatchColor=RGB(196, 86, 18))
extr_28 = Extrude(Base=move_22.Geometry, Direction=dispatch_28.ListA)
panel_211 = Panel("Kurve Abdichtung Außen")
panel_212 = Panel("Kurve Abdichtung")
panel_214 = Panel("Dicke Dämmung")
panel_215 = Panel("Kurve Putz")
cap = CapHoles(Brep=extr_28)
num_44 = Number(data_23)
num_45 = Number(data_22)
# Mass Addition Dicke Bodenaufbau
num_46 = Number(data_20)
fastsdiff_11 = FastSolidDifference(
    SubtractFrom=graft(cap),
    SubtractWith=data_26,
    Tolerance=0.01,
    UseTasks=True,
    computeBBFastSolidDiff=True,
    retainFastSolidDiff=True,
    strictFastSolidDiff=True,
    trueIntFastSolidDiff=False)
# Mass Addition Dicke Bodenaufbau
num_47 = Number(data_23)
# Mass Addition Dicke Bodenaufbau
num_48 = Number(data_21)
frame_preview_color_23 = ColourSwatch(SwatchColor=RGB(227, 221, 104))
# Mass Addition Dicke Bodenaufbau
addition_5 = Addition(A=num_44, B=num_45)
fastsdiff_12 = FastSolidDifference(
    SubtractFrom=graft(extr_27),
    SubtractWith=data_26,
    Tolerance=0.01,
    computeBBFastSolidDiff=True,
    retainFastSolidDiff=True,
    strictFastSolidDiff=True,
    trueIntFastSolidDiff=False)
frame_preview_color_24 = ColourSwatch(SwatchColor=RGB(163, 94, 34))
neg_9 = Negative(Value=ma_2.Result)
neg_10 = Negative(Value=ma_2.Result)
neg_11 = Negative(Value=ma_2.Result)
Z_45 = UnitZ(Factor=subtraction_6)
neg_12 = Negative(Value=ma_2.Result)
Z_46 = UnitZ(Factor=neg_9)
Z_47 = UnitZ(Factor=neg_10)
Z_48 = UnitZ(Factor=neg_11)
frame_preview_color_25 = ColourSwatch(SwatchColor=RGB(191, 146, 11))
frame_preview_color_26 = ColourSwatch(SwatchColor=RGB(191, 146, 11))
Z_49 = UnitZ(Factor=neg_12)
frame_preview_color_27 = ColourSwatch(SwatchColor=RGB(196, 196, 196))
frame_preview_color_28 = ColourSwatch(SwatchColor=RGB(0, 0, 0))
frame_preview_color_29 = ColourSwatch(SwatchColor=RGB(153, 214, 152))
frame_preview_color_30 = ColourSwatch(SwatchColor=RGB(214, 198, 152))
frame_preview_color_31 = ColourSwatch(SwatchColor=RGB(214, 198, 152))
panel_224 = Panel("Logik Holzbau Wechsel")
panel_225 = Panel("Oben -> Holzbau")
panel_228 = Panel("Kurve Massiv")
panel_229 = Panel("Kurve Holz")

# ---- group: Logik Wand Kurven
# Boolean Switch Holz Stein
# Boolean Switch Holz Stein
# Boolean Switch Holz Stein
# Boolean Switch Holz Stein
# Boolean Switch Holz Stein
panel_232 = Panel("Kurve Massiv")
crv_29 = Curve(flip.Curve)
panel_238 = Panel("Innenkurve Abdichtung")
panel_239 = Panel("Innenkurve Wand")
panel_240 = Panel("Innenkurve Dämmung")
panel_241 = Panel("Innenkurve Putz")
bool_7 = Boolean(switch_holz_stein)
offset_14 = OffsetCurve(Curve=crv_29, Distance=data_24, Corners=1)
bool_8 = Boolean(switch_holz_stein)
data_27 = Data(offset_7)
bool_9 = Boolean(switch_holz_stein)
data_28 = Data(offset_4)
data_29 = Data(offset_2)
data_30 = Data(offset_8)
data_31 = Data(offset)
panel_242 = Panel("Außenkurve Rand")
data_32 = Data(offset_3)
bool_10 = Boolean(switch_holz_stein)
data_33 = Data(offset_9)
data_34 = Data(offset_6)
bool_11 = Boolean(switch_holz_stein)
data_35 = Data(offset_10)
data_36 = Data(offset_12)
p_n_c_7 = PickNChoose(Pattern=bool_8, Stream0=data_28, Stream1=data_31)
p_n_c_8 = PickNChoose(Pattern=bool_7, Stream0=data_27, Stream1=data_29)
p_n_c_9 = PickNChoose(Pattern=bool_9, Stream0=data_30, Stream1=data_32)
p_n_c_10 = PickNChoose(Pattern=bool_11, Stream0=data_35, Stream1=data_36)
p_n_c_11 = PickNChoose(Pattern=bool_10, Stream0=data_33, Stream1=data_34)
data_37 = Data(p_n_c_7)
data_38 = Data(p_n_c_8)
data_39 = Data(p_n_c_9)
data_40 = Data(p_n_c_11)
data_41 = Data(offset_14)

# ----
crv_30 = Curve(data_37)
fpatch_6 = FragmentPatch(Boundary=crv_30)
crv_31 = Curve(crv_30)
move_24 = Move(Geometry=fpatch_6, Motion=neg_3)  # -> Geometry, Transform
srf = Surface(move_24.Geometry)
move_25 = Move(Geometry=srf, Motion=neg_4)  # -> Geometry, Transform
srf_2 = Surface(move_25.Geometry)
extr_29 = Extrude(Base=fpatch_6, Direction=neg_3)
extr_30 = Extrude(Base=srf, Direction=neg_4)
move_26 = Move(Geometry=srf_2, Motion=neg_5)  # -> Geometry, Transform
srf_3 = Surface(move_26.Geometry)
extr_31 = Extrude(Base=srf_2, Direction=neg_5)
move_27 = Move(Geometry=srf_3, Motion=neg_6)  # -> Geometry, Transform
srf_4 = Surface(move_27.Geometry)
move_28 = Move(Geometry=srf_4, Motion=neg_7)  # -> Geometry, Transform
extr_32 = Extrude(Base=srf_3, Direction=neg_6)
extr_33 = Extrude(Base=srf_4, Direction=neg_7)
offset_15 = OffsetCurve(Curve=crv_31, Distance=num_36, Corners=1)
boundary_13 = BoundarySurfaces(Edges=flatten([crv_31, offset_15]))

panel_243 = Panel("Dampfsperre")
panel_244 = Panel("Bodenplatte")
panel_245 = Panel("Fußbodendämmung")
frame_preview_color_32 = ColourSwatch(SwatchColor=RGB(108, 150, 59))
frame_preview_color_33 = ColourSwatch(SwatchColor=RGB(214, 214, 214))
frame_preview_color_34 = ColourSwatch(SwatchColor=RGB(196, 196, 196))
frame_preview_color_35 = ColourSwatch(SwatchColor=RGB(0, 0, 0))
panel_246 = Panel("Bodenbelag")
panel_247 = Panel("Estrich")
frame_preview_color_36 = ColourSwatch(SwatchColor=RGB(161, 152, 56))
data_42 = Data(extr_29)
data_43 = Data(extr_30)
data_44 = Data(extr_32)
data_45 = Data(extr_33)
data_46 = Data(extr_31)
preview_10 = CustomPreview(Geometry=data_42, Material=frame_preview_color_32)
preview_11 = CustomPreview(Geometry=data_43, Material=frame_preview_color_33)
preview_12 = CustomPreview(Geometry=data_44, Material=frame_preview_color_35)
preview_13 = CustomPreview(Geometry=data_45, Material=frame_preview_color_34)
preview_14 = CustomPreview(Geometry=data_46, Material=frame_preview_color_36)

extr_34 = Extrude(Base=boundary_13, Direction=Z_42)
data_47 = Data(extr_34)
move_29 = Move(Geometry=offset_15, Motion=Z_42)  # -> Geometry, Transform
offset_16 = OffsetCurve(Curve=move_29.Geometry, Distance=ma_3.Result, Corners=1)
crv_32 = Curve(data_38)
crv_33 = Curve(data_39)
crv_34 = Curve(data_40)
crv_35 = Curve(data_40)
offset_17 = OffsetCurve(Curve=crv_32, Distance=num_46, Corners=1)
offset_18 = OffsetCurve(Curve=crv_33, Distance=num_48, Corners=1)
offset_19 = OffsetCurve(Curve=crv_34, Distance=num_47, Corners=1)
boundary_14 = BoundarySurfaces(Edges=flatten([offset_16, move_29.Geometry]))
offset_20 = OffsetCurve(Curve=crv_35, Distance=addition_5, Corners=1)
boundary_15 = BoundarySurfaces(Edges=flatten([crv_32, offset_17]))
boundary_16 = BoundarySurfaces(Edges=flatten([crv_33, offset_18]))
boundary_17 = BoundarySurfaces(Edges=flatten([crv_34, offset_19]))
boundary_18 = BoundarySurfaces(Edges=flatten([crv_35, offset_20]))
extr_35 = Extrude(Base=boundary_14, Direction=Z_45)
extr_36 = Extrude(Base=boundary_15, Direction=Z_46)
extr_37 = Extrude(Base=boundary_16, Direction=Z_47)
extr_38 = Extrude(Base=boundary_17, Direction=Z_48)
extr_39 = Extrude(Base=boundary_18, Direction=Z_49)
dispatch_29 = Dispatch(List=extr_38, DispatchPattern=switch_holz_stein)  # -> ListA, ListB
dispatch_30 = Dispatch(List=extr_39, DispatchPattern=switch_holz_stein)  # -> ListA, ListB
preview_15 = CustomPreview(Geometry=[data_47, extr_35], Material=frame_preview_color_27)
preview_16 = CustomPreview(Geometry=extr_36, Material=frame_preview_color_28)
preview_17 = CustomPreview(Geometry=extr_37, Material=frame_preview_color_29)
preview_18 = CustomPreview(Geometry=dispatch_29.ListA, Material=frame_preview_color_30)
preview_19 = CustomPreview(Geometry=dispatch_30.ListB, Material=frame_preview_color_31)
num_49 = Number(num)
dicke_betondecke = Slider(0.2, range=0.07..0.25)
dicke_dampfsperre_2 = Slider(0.011, range=0.011..0.02)
dicke_dämmung_2 = Slider(0.1, range=0..0.25)
überstand_attika = Slider(0.3, range=0.3..0.5)
ma_4 = MassAddition(Input=[dicke_betondecke, dicke_dampfsperre_2, dicke_dämmung_2, überstand_attika, data_20])  # -> Result, PartialResults
höhe_attika = Number(ma_4.Result)
num_50 = Number(höhe_attika)
ma_5 = MassAddition(Input=[num_39, num_50])  # -> Result, PartialResults
dispatch_31 = Dispatch(List=ma_5.Result, DispatchPattern=switch_flach_walmdach)  # -> ListA, ListB
Z_50 = UnitZ(Factor=dispatch_31.ListA)
extr_40 = Extrude(Base=move_23.Geometry, Direction=Z_50)
cap_2 = CapHoles(Brep=extr_40)
fastsdiff_13 = FastSolidDifference(
    SubtractFrom=graft(cap_2),
    SubtractWith=data_26,
    Tolerance=0.01,
    computeBBFastSolidDiff=True,
    retainFastSolidDiff=True,
    strictFastSolidDiff=True,
    trueIntFastSolidDiff=False)
data_48 = Data(fastsdiff_13)
preview_20 = CustomPreview(Geometry=data_48, Material=frame_preview_color_25)
panel_249 = Panel("C:\Users\mfls\OneDrive\Uni\Master\Code\Tinyhouse Generator\files\EpwZipUrls.csv")

# ---- group: Holz Attika
# Nur Aktiv wenn Holz Aktiv
# Raumhöhe - Höhe Ringbalken Unten
panel_250 = Panel("Höhe Attika")
num_51 = Number(höhe_attika)
panel_251 = Panel("Höhe Deckenplatte")
dicke_abschlussbrett = Slider(0.03, range=0..0.1)
subtraction_7 = Subtraction(A=num_51, B=dicke_betondecke)
panel_253 = Panel("Dicke Abschlussbrett")
panel_256 = Panel("Kuve Dämmung Oben")
addition_6 = Addition(A=num_49, B=dicke_betondecke)
rectangle_5 = Rectangle(Plane=PlaneXY(0, 0, 0), XSize=dicke_wand_2, YSize=dicke_abschlussbrett, Radius=0)  # -> Rectangle, Length
subtraction_8 = Subtraction(A=subtraction_7, B=dicke_abschlussbrett)
crv_36 = Curve(move_19.Geometry)
dispatch_32 = Dispatch(List=data_37, DispatchPattern=switch_flach_walmdach)  # -> ListA, ListB
Z_51 = UnitZ(Factor=addition_6)
dispatch_33 = Dispatch(List=move_22.Geometry, DispatchPattern=switch_holz_stein)  # -> ListA, ListB
num_52 = Number(data_19)
dispatch_34 = Dispatch(List=crv_36, DispatchPattern=switch_flach_walmdach)  # -> ListA, ListB
move_30 = Move(Geometry=dispatch_32.ListA, Motion=Z_51)  # -> Geometry, Transform
dispatch_35 = Dispatch(List=dispatch_33.ListA, DispatchPattern=switch_flach_walmdach)  # -> ListA, ListB
num_53 = Number(höhe_attika)
num_54 = Number()
Z_52 = UnitZ(Factor=num_53)
rectangle_6 = Rectangle(Plane=PlaneXY(0, 0, 0), XSize=subtraction_8, YSize=num_52, Radius=0)  # -> Rectangle, Length
Z_53 = UnitZ(Factor=num_54)
move_31 = Move(Geometry=dispatch_34.ListA, Motion=Z_52)  # -> Geometry, Transform
subtraction_9 = Subtraction(A=höhe_attika, B=dicke_abschlussbrett)
cluster_2 = Cluster(grundriss=move_30.Geometry, A=Slider(180, range=-180..180), wand=rectangle_6.Rectangle)
move_32 = Move(Geometry=dispatch_35.ListA, Motion=Z_53)  # -> Geometry, Transform
panel_269 = Panel("Dicke Ringbalken / Decke")
cluster_3 = Cluster(grundriss=move_31.Geometry, A=Slider(0, range=-180..180), wand=rectangle_5.Rectangle)
num_55 = Number(dicke_betondecke)
frame_preview_color_37 = ColourSwatch(SwatchColor=RGB(196, 86, 18))
data_49 = Data(cluster_3)
cap_3 = CapHoles(Brep=data_49)
subtraction_10 = Subtraction(A=subtraction_9, B=num_55)
Z_54 = UnitZ(Factor=num_55)
data_50 = Data(cluster_2)
preview_21 = CustomPreview(Geometry=cap_3, Material=frame_preview_color_37)
move_33 = Move(Geometry=move_32.Geometry, Motion=Z_54)  # -> Geometry, Transform
Z_55 = UnitZ(Factor=subtraction_10)
extr_41 = Extrude(Base=move_33.Geometry, Direction=Z_55)
frame_preview_color_38 = ColourSwatch(SwatchColor=RGB(196, 86, 18))
cap_4 = CapHoles(Brep=extr_41)
frame_preview_color_39 = ColourSwatch(SwatchColor=RGB(227, 221, 104))
preview_22 = CustomPreview(Geometry=cap_4, Material=frame_preview_color_38)
fastsdiff_14 = FastSolidDifference(
    SubtractFrom=data_50,
    SubtractWith=cap_4,
    Tolerance=0.01,
    computeBBFastSolidDiff=True,
    retainFastSolidDiff=True,
    strictFastSolidDiff=True,
    trueIntFastSolidDiff=False)
preview_23 = CustomPreview(Geometry=fastsdiff_14, Material=frame_preview_color_39)

# ----
panel_270 = Panel("Dicke Aufbau Attika")

dispatch_36 = Dispatch(List=data_37, DispatchPattern=switch_flach_walmdach)  # -> ListA, ListB
Z_56 = UnitZ(Factor=num_49)
move_34 = Move(Geometry=dispatch_36.ListA, Motion=Z_56)  # -> Geometry, Transform
offset_21 = OffsetCurve(Curve=move_34.Geometry, Distance=data_19, Corners=1)
boundary_19 = BoundarySurfaces(Edges=flatten([offset_21, move_34.Geometry]))
Z_57 = UnitZ(Factor=höhe_attika)
extr_42 = Extrude(Base=boundary_19, Direction=Z_57)
frame_preview_color_40 = ColourSwatch(SwatchColor=RGB(196, 196, 196))
dispatch_37 = Dispatch(List=extr_42, DispatchPattern=switch_holz_stein)  # -> ListA, ListB
preview_24 = CustomPreview(Geometry=dispatch_37.ListB, Material=frame_preview_color_40)

# ----
# Hier noch korregieren Holz
# Randkurve Wand für Sweep Innere Abdichtung
# Brep Mauer für Abdichtung Oberseite Mauer
panel_278 = Panel("Raumhöhe")
dispatch_38 = Dispatch(List=data_38, DispatchPattern=switch_flach_walmdach)  # -> ListA, ListB
Z_58 = UnitZ(Factor=num_49)
num_56 = Number(data_20)
move_35 = Move(Geometry=dispatch_38.ListA, Motion=Z_58)  # -> Geometry, Transform
num_57 = Number(höhe_attika)
offset_22 = OffsetCurve(Curve=move_35.Geometry, Distance=num_56, Corners=1)
addition_7 = Addition(A=num_57, B=num_56)
boundary_20 = BoundarySurfaces(Edges=flatten([move_35.Geometry, offset_22]))
Z_59 = UnitZ(Factor=addition_7)
extr_43 = Extrude(Base=boundary_20, Direction=Z_59)
Z_60 = UnitZ(Factor=höhe_attika)
brep_4 = Brep(boundary_19)
move_36 = Move(Geometry=brep_4, Motion=Z_60)  # -> Geometry, Transform
Z_61 = UnitZ(Factor=num_56)
extr_44 = Extrude(Base=move_36.Geometry, Direction=Z_61)
addition_8 = Addition(A=höhe_attika, B=num_49)
num_58 = Number(data_20)
crv_37 = Curve(data_37)
addition_9 = Addition(A=addition_8, B=num_58)
dispatch_39 = Dispatch(List=crv_37, DispatchPattern=switch_flach_walmdach)  # -> ListA, ListB
Z_62 = UnitZ(Factor=addition_9)
panel_289 = Panel("Dicke Deckenplatte")
move_37 = Move(Geometry=dispatch_39.ListA, Motion=Z_62)  # -> Geometry, Transform
num_59 = Number(höhe_attika)
neg_13 = Negative(Value=num_58)
subtraction_11 = Subtraction(A=num_59, B=dicke_betondecke)
offset_23 = OffsetCurve(Curve=move_37.Geometry, Distance=neg_13, Corners=1)
neg_14 = Negative(Value=subtraction_11)
boundary_21 = BoundarySurfaces(Edges=flatten([offset_23, move_37.Geometry]))
Z_63 = UnitZ(Factor=neg_14)
extr_45 = Extrude(Base=boundary_21, Direction=Z_63)
data_51 = Data(extr_45)
frame_preview_color_41 = ColourSwatch(SwatchColor=RGB(0, 0, 0))
preview_25 = CustomPreview(Geometry=[extr_44, extr_43, data_51], Material=frame_preview_color_41)

# ----
# Randkurve Wand für Sweep Innere Dämmung
# Kurve Abdichtung Dach Oben Außen
panel_291 = Panel("Raumhöhe")
dispatch_40 = Dispatch(List=data_39, DispatchPattern=switch_flach_walmdach)  # -> ListA, ListB
Z_64 = UnitZ(Factor=num_49)
panel_294 = Panel("Dicke Aüßere Dämmung")
move_38 = Move(Geometry=dispatch_40.ListA, Motion=Z_64)  # -> Geometry, Transform
panel_295 = Panel("Dicke Dach Dämmung")
num_60 = Number(data_21)
num_61 = Number(höhe_attika)
num_62 = Number(dicke_dämmung_2)
offset_24 = OffsetCurve(Curve=move_38.Geometry, Distance=num_60, Corners=1)
addition_10 = Addition(A=num_61, B=num_62)
boundary_22 = BoundarySurfaces(Edges=flatten([move_38.Geometry, offset_24]))
Z_65 = UnitZ(Factor=addition_10)
frame_preview_color_42 = ColourSwatch(SwatchColor=RGB(153, 214, 152))
extr_46 = Extrude(Base=boundary_22, Direction=Z_65)
data_52 = Data(extr_46)
preview_26 = CustomPreview(Geometry=data_52, Material=frame_preview_color_42)
num_63 = Number(data_20)
multiplication_26 = Multiplication(A=num_63, B="2")
crv_38 = Curve(offset_23)
num_64 = Number(data_19)
addition_11 = Addition(A=num_64, B=multiplication_26)
offset_25 = OffsetCurve(Curve=crv_38, Distance=addition_11, Corners=1)
num_65 = Number(dicke_dämmung_2)
num_66 = Number(data_20)
boundary_23 = BoundarySurfaces(Edges=flatten([crv_38, offset_25]))
subtraction_12 = Subtraction(A=num_65, B=num_66)
frame_preview_color_43 = ColourSwatch(SwatchColor=RGB(189, 93, 49))
Z_66 = UnitZ(Factor=subtraction_12)
extr_47 = Extrude(Base=boundary_23, Direction=Z_66)
preview_27 = CustomPreview(Geometry=extr_47, Material=frame_preview_color_43)
num_67 = Number(dicke_dämmung_2)
addition_12 = Addition(A=höhe_attika, B=num_49)
num_68 = Number(data_20)
crv_39 = Curve(data_37)
addition_13 = Addition(A=addition_12, B=num_67)
dispatch_41 = Dispatch(List=crv_39, DispatchPattern=switch_flach_walmdach)  # -> ListA, ListB
Z_67 = UnitZ(Factor=addition_13)
move_39 = Move(Geometry=dispatch_41.ListA, Motion=Z_67)  # -> Geometry, Transform
neg_15 = Negative(Value=num_68)
offset_26 = OffsetCurve(Curve=move_39.Geometry, Distance=neg_15, Corners=1)
neg_16 = Negative(Value=num_67)
num_69 = Number(höhe_attika)
offset_27 = OffsetCurve(Curve=offset_26, Distance=neg_16, Corners=1)
subtraction_13 = Subtraction(A=num_69, B=dicke_betondecke)
neg_17 = Negative(Value=subtraction_13)
boundary_24 = BoundarySurfaces(Edges=flatten([offset_27, offset_26]))
Z_68 = UnitZ(Factor=neg_17)
extr_48 = Extrude(Base=boundary_24, Direction=Z_68)
data_53 = Data(extr_48)
panel_309 = Panel("Abzug Abdichtung")
frame_preview_color_44 = ColourSwatch(SwatchColor=RGB(189, 93, 49))
fastsdiff_15 = FastSolidDifference(
    SubtractFrom=data_53,
    SubtractWith=data_51,
    Tolerance=0.01,
    computeBBFastSolidDiff=True,
    retainFastSolidDiff=True,
    strictFastSolidDiff=True,
    trueIntFastSolidDiff=False)
preview_28 = CustomPreview(Geometry=fastsdiff_15, Material=frame_preview_color_44)

dispatch_42 = Dispatch(List=data_37, DispatchPattern=switch_flach_walmdach)  # -> ListA, ListB
Z_69 = UnitZ(Factor=num_49)
move_40 = Move(Geometry=dispatch_42.ListA, Motion=Z_69)  # -> Geometry, Transform
panel_313 = Panel("Dicke Betondecke")
Z_70 = UnitZ(Factor=dicke_betondecke)
fpatch_7 = FragmentPatch(Boundary=move_40.Geometry)
number_slider_4 = Slider(2.86, range=1..5)
extr_49 = Extrude(Base=fpatch_7, Direction=Z_70)
move_41 = Move(Geometry=move_40.Geometry, Motion=Z_70)  # -> Geometry, Transform
roof = ModelRoof(Curve=move_41.Geometry, Angle=number_slider_4, indexSize=1, showIndices=False)
join_8 = BrepJoin(Breps=roof)  # -> Breps, Closed
bbox = BoundingBox(Content=join_8.Breps, Plane=PlaneXY(0, 0, 0))  # -> Box, Box_2
debox = DeconstructBox(Box=bbox.Box)  # -> Plane, X, Y, Z
Z_71 = UnitZ(Factor=debox.Z)
rev_2 = Reverse(Vector=Z_71)
frame_preview_color_45 = ColourSwatch(SwatchColor=RGB(94, 94, 94))
extr_50 = Extrude(Base=join_8.Breps, Direction=rev_2)
data_54 = Data(extr_49)
panel_314 = Panel("Betondecke")
brep_5 = Brep(join_8.Breps)
preview_29 = CustomPreview(Geometry=data_54, Material=frame_preview_color_45)
fastsdiff_16 = FastSolidDifference(
    SubtractFrom=extr_50,
    SubtractWith=extr_49,
    Tolerance=0.01,
    computeBBFastSolidDiff=True,
    retainFastSolidDiff=True,
    strictFastSolidDiff=True,
    trueIntFastSolidDiff=False)
panel_315 = Panel("Dicke Dampfsperre")
frame_preview_color_46 = ColourSwatch(SwatchColor=RGB(189, 189, 189))
panel_316 = Panel("Gefälleestrich")
data_55 = Data(fastsdiff_16)
Z_72 = UnitZ(Factor=dicke_dampfsperre_2)
preview_30 = CustomPreview(Geometry=data_55, Material=frame_preview_color_46)
move_42 = Move(Geometry=brep_5, Motion=Z_72)  # -> Geometry, Transform
extr_51 = Extrude(Base=brep_5, Direction=Z_72)
frame_preview_color_47 = ColourSwatch(SwatchColor=RGB(0, 0, 0))
Z_73 = UnitZ(Factor=dicke_dämmung_2)
data_56 = Data(extr_51)
preview_31 = CustomPreview(Geometry=data_56, Material=frame_preview_color_47)
extr_52 = Extrude(Base=move_42.Geometry, Direction=Z_73)
move_43 = Move(Geometry=move_42.Geometry, Motion=Z_73)  # -> Geometry, Transform
fastsdiff_17 = FastSolidDifference(
    SubtractFrom=extr_52,
    SubtractWith=data_51,
    Tolerance=0.01,
    computeBBFastSolidDiff=True,
    retainFastSolidDiff=True,
    strictFastSolidDiff=True,
    trueIntFastSolidDiff=False)
Z_74 = UnitZ(Factor=data_20)
frame_preview_color_48 = ColourSwatch(SwatchColor=RGB(189, 93, 49))
panel_321 = Panel("""Abzug Abdichtung
+ Dämmung""")
extr_53 = Extrude(Base=move_43.Geometry, Direction=Z_74)
data_57 = Data(fastsdiff_17)
preview_32 = CustomPreview(Geometry=data_57, Material=frame_preview_color_48)
fastsdiff_18 = FastSolidDifference(
    SubtractFrom=extr_53,
    SubtractWith=[data_51, data_53],
    Tolerance=0.01,
    computeBBFastSolidDiff=True,
    retainFastSolidDiff=True,
    strictFastSolidDiff=True,
    trueIntFastSolidDiff=False)
frame_preview_color_49 = ColourSwatch(SwatchColor=RGB(138, 61, 61))
data_58 = Data(fastsdiff_18)
preview_33 = CustomPreview(Geometry=data_58, Material=frame_preview_color_49)

# ----
# Kurve Dämmung Dach Oben Außen
panel_324 = Panel("Raumhöhe")
dispatch_43 = Dispatch(List=data_40, DispatchPattern=switch_flach_walmdach)  # -> ListA, ListB
Z_75 = UnitZ(Factor=num_49)
move_44 = Move(Geometry=dispatch_43.ListA, Motion=Z_75)  # -> Geometry, Transform
num_70 = Number(dicke_dämmung_2)
num_71 = Number(höhe_attika)
num_72 = Number(data_23)
ma_6 = MassAddition(Input=[num_71, num_70])  # -> Result, PartialResults
offset_28 = OffsetCurve(Curve=move_44.Geometry, Distance=num_72, Corners=1)
boundary_25 = BoundarySurfaces(Edges=flatten([offset_28, move_44.Geometry]))
Z_76 = UnitZ(Factor=ma_6.Result)
frame_preview_color_50 = ColourSwatch(SwatchColor=RGB(214, 198, 152))
extr_54 = Extrude(Base=boundary_25, Direction=Z_76)
data_59 = Data(extr_54)
preview_34 = CustomPreview(Geometry=data_59, Material=frame_preview_color_50)
num_73 = Number(höhe_attika)
num_74 = Number(dicke_dämmung_2)
addition_14 = Addition(A=num_73, B=num_74)
Z_77 = UnitZ(Factor=addition_14)
move_45 = Move(Geometry=offset_28, Motion=Z_77)  # -> Geometry, Transform
crv_40 = Curve(offset_27)
boundary_26 = BoundarySurfaces(Edges=flatten([move_45.Geometry, crv_40]))
num_75 = Number(data_20)
Z_78 = UnitZ(Factor=num_75)
frame_preview_color_51 = ColourSwatch(SwatchColor=RGB(138, 61, 61))
extr_55 = Extrude(Base=boundary_26, Direction=Z_78)
preview_35 = CustomPreview(Geometry=extr_55, Material=frame_preview_color_51)
move_46 = Move(Geometry=crv_40, Motion=Z_78)  # -> Geometry, Transform
num_76 = Number(höhe_attika)
num_77 = Number(data_20)
subtraction_14 = Subtraction(A=num_76, B=dicke_betondecke)
neg_18 = Negative(Value=num_77)
offset_29 = OffsetCurve(Curve=move_46.Geometry, Distance=neg_18, Corners=1)
addition_15 = Addition(A=subtraction_14, B=num_77)
neg_19 = Negative(Value=addition_15)
boundary_27 = BoundarySurfaces(Edges=flatten([offset_29, move_46.Geometry]))
frame_preview_color_52 = ColourSwatch(SwatchColor=RGB(138, 61, 61))
Z_79 = UnitZ(Factor=neg_19)
extr_56 = Extrude(Base=boundary_27, Direction=Z_79)
preview_36 = CustomPreview(Geometry=extr_56, Material=frame_preview_color_52)

num_78 = Number(data_20)
num_79 = Number(data_20)
num_80 = Number(data_21)
num_81 = Number(dicke_dämmung_2)
num_82 = Number(data_19)
num_83 = Number(dicke_dampfsperre_2)
num_84 = Number(data_22)
num_85 = Number(data_23)

# ---- group: Dach Grundform
data_60 = Data(data_41)
dachüberstand = Slider(0.3, range=0..1)
dispatch_44 = Dispatch(List=data_60, DispatchPattern=switch_flach_walmdach)  # -> ListA, ListB
crv_41 = Curve(flatten(dispatch_44.ListB))
offset_30 = OffsetCurve(Curve=crv_41, Distance=dachüberstand, Corners=1)
Z_80 = UnitZ(Factor=num)
move_47 = Move(Geometry=crv_41, Motion=Z_80)  # -> Geometry, Transform
move_48 = Move(Geometry=offset_30, Motion=Z_80)  # -> Geometry, Transform
roof_2 = ModelRoof(Curve=move_48.Geometry, Angle=Slider(30, range=5..89), indexSize=1, showIndices=False)
join_9 = BrepJoin(Breps=roof_2)  # -> Breps, Closed

# ----
python_2 = GhPythonScript(csv_path=panel_249, target_lat=Slider(37.9527, range=0..90), target_lon=Slider(64.6329, range=0..90))  # -> nearest_station_url, shortest_distance; same code as python
panel_338 = Panel("Abdichtung 2 mal")
panel_339 = Panel("Dachaufbau höhe")  # disabled
num_86 = Number(num_78)
num_87 = Number(num_78)
panel_340 = Panel("Dicke Dichtung")
panel_344 = Panel("Dachneigung Flachdach")
dispatch_45 = Dispatch(List=data_41, DispatchPattern=switch_flach_walmdach)  # -> ListA, ListB
addition_16 = Addition(A=höhe_attika, B=num_49)
panel_347 = Panel("Kurve ganz Außen")  # disabled
panel_348 = Panel("Brep Dach Außen")  # disabled
num_88 = Number(data_20)
num_89 = Number(dicke_dämmung_2)
ma_7 = MassAddition(Input=[num_78, num_79, num_81, num_80, num_82, num_83, num_87, num_84, num_86, num_85])  # -> Result, PartialResults
rad_2 = Radians(Degrees=number_slider_4)
panel_349 = Panel(python_2.nearest_station_url)
addition_17 = Addition(A=addition_16, B=num_88)
tan = Tangent(Value=rad_2)
addition_18 = Addition(A=num_89, B=addition_17)
crv_42 = Curve(data_41)  # disabled
panel_350 = Panel("http://climate.onebuilding.org/WMO_Region_4_North_and_Central_America/USA_United_States_of_America/NC_North_Carolina/USA_NC_Charlotte.Douglas.Intl.AP.723140_TMY3.zip")  # disabled
multiplication_27 = Multiplication(A=tan, B=ma_7.Result)
neg_20 = Negative(Value=ma_7.Result)
addition_19 = Addition(A=addition_18)
Z_81 = UnitZ(Factor=multiplication_27)
Z_82 = UnitZ(Factor=addition_19)
downloadepw = LBDownloadWeather(weather_URL=panel_350)  # -> epw_file, stat_file, ddy_file; disabled; plug-in component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
num_90 = Number(höhe_attika)
move_49 = Move(Geometry=dispatch_45.ListA, Motion=Z_82)  # -> Geometry, Transform
division = Division(A=num_90, B="4")
offset_31 = OffsetCurve(Curve=move_49.Geometry, Distance=neg_20, Corners=1)
importepw = LBImportEPW(epw_file=downloadepw.epw_file)  # -> location, dry_bulb_temperature, dew_point_temperature, relative_humidity, wind_speed, wind_direction, direct_normal_rad, diffuse_horizontal_rad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; disabled; plug-in component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
neg_21 = Negative(Value=division)
toggle = BooleanToggle(True)  # disabled
Z_83 = UnitZ(Factor=neg_21)
move_50 = Move(Geometry=offset_31, Motion=Z_81)  # -> Geometry, Transform
decnstrloc = LBDeconstructLocation(location=importepw.location)  # -> name, latitude, longitude, time_zone, elevation; disabled; plug-in component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
move_51 = Move(Geometry=move_49.Geometry, Motion=Z_83)  # -> Geometry, Transform
num_91 = Number(höhe_attika)
loft = Loft(
    Curves=flatten([move_50.Geometry, move_49.Geometry]),
    Options={Adjust=False, Closed=False, LoftEnds=0, LoftSimp=0, LoftType=0, Rebuild=10, Refit=0.01})
division_2 = Division(A=num_91, B="4")
skymatrix = LBCumulativeSkyMatrix(location=importepw.location, direct_rad=importepw.direct_normal_rad, diffuse_rad=importepw.diffuse_horizontal_rad)  # -> report, sky_mtx; disabled; plug-in component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
loft_2 = Loft(
    Curves=flatten([move_49.Geometry, move_51.Geometry]),
    Options={Adjust=False, Closed=False, LoftEnds=0, LoftSimp=0, LoftType=0, Rebuild=10, Refit=0.01})
toggle_2 = BooleanToggle(True)  # disabled
number_slider_5 = Slider(0.5, range=0.1..1)  # disabled
neg_22 = Negative(Value=division_2)
panel_353 = Panel(decnstrloc.name)  # disabled
panel_354 = Panel(decnstrloc.latitude)  # disabled
panel_355 = Panel(decnstrloc.longitude)  # disabled

# ---- group: Dachbalken
höhe_dachträger = Slider(0.3, range=0..1)
breite_dachträger = Slider(0.3, range=0..1)
edges_10 = BrepEdges(Brep=join_9.Breps)  # -> Naked, graft(Interior), NonManifold
neg_23 = Negative(Value=höhe_dachträger)
join_10 = JoinCurves(Curves=edges_10.Naked, Preserve=False)
Z_84 = UnitZ(Factor=neg_23)
crv_43 = Curve(edges_10.Interior)
move_52 = Move(Geometry=crv_43, Motion=Z_84)  # -> Geometry, Transform
rad_3 = Radians(Degrees="90")
xy_2 = XYPlane(Origin=Point(0, 0, 0))
eval_3 = EvaluateCurve(Curve=move_52.Geometry, Parameter="0")  # -> Point, Tangent, Angle
Z_85 = UnitZ(Factor=1)
crv_44 = Curve(join_10)
rulesrf = RuledSurface(CurveA=crv_43, CurveB=move_52.Geometry)
pdecon = Deconstruct(Point=eval_3.Tangent)  # -> XComponent, YComponent, ZComponent
move_53 = Move(Geometry=crv_44, Motion=Z_85)  # -> Geometry, Transform
vec_9 = VectorXYZ(XComponent=pdecon.XComponent, YComponent=pdecon.YComponent, ZComponent=0)  # -> Vector, Length
rotate_2 = Rotate(Geometry=vec_9.Vector, Angle=rad_3, Plane=xy_2)  # -> Geometry, Transform
division_3 = Division(A=breite_dachträger, B="2")
multiplication_28 = Multiplication(A=rotate_2.Geometry, B=division_3)
Z_86 = UnitZ(Factor="-2")
neg_24 = Negative(Value=multiplication_28)
extr_57 = Extrude(Base=move_53.Geometry, Direction=Z_86)
flippsrf = FlipPolysurface(Polysurface=extr_57)  # -> Flipped, R
offsrf_2 = OffsetSurface(Surface=flippsrf.Flipped, Distance="1", BothSides=0, CreateSolid=True)
extr_58 = Extrude(Base=rulesrf, Direction=[neg_24, multiplication_28])
cap_5 = CapHoles(Brep=extr_58)
Z_87 = UnitZ(Factor=1)
fastsunion = FastSolidUnion(Breps=flatten(cap_5), Tolerance=0.01, strictFastSolidUnion=True, trueIntFastSolidUnion=False)  # -> graft(Result)
extr_59 = Extrude(Base=join_9.Breps, Direction=Z_87)
fastsdiff_19 = FastSolidDifference(
    SubtractFrom=fastsunion,
    SubtractWith=offsrf_2,
    Tolerance=0.01,
    computeBBFastSolidDiff=True,
    retainFastSolidDiff=True,
    strictFastSolidDiff=True,
    trueIntFastSolidDiff=False)
fastsdiff_20 = FastSolidDifference(
    SubtractFrom=fastsdiff_19,
    SubtractWith=extr_59,
    Tolerance=0.01,
    computeBBFastSolidDiff=True,
    retainFastSolidDiff=True,
    strictFastSolidDiff=True,
    trueIntFastSolidDiff=False)
frame_preview_color_53 = ColourSwatch(SwatchColor=RGB(143, 78, 31))
preview_37 = CustomPreview(Geometry=fastsdiff_20, Material=frame_preview_color_53)

# ----
Z_88 = UnitZ(Factor=neg_22)
move_54 = Move(Geometry=move_50.Geometry, Motion=Z_88)  # -> Geometry, Transform
panel_356 = Panel("Verschiebung Geo Pfetten")
loft_3 = Loft(
    Curves=flatten([move_54.Geometry, move_50.Geometry]),
    Options={Adjust=False, Closed=False, LoftEnds=0, LoftSimp=0, LoftType=0, Rebuild=10, Refit=0.01})
join_11 = BrepJoin(Breps=[loft_2, loft, loft_3])  # -> Breps, Closed
abdeckung_dach_dicke = Slider(0.015, range=0.01..0.02)
offsrf_3 = OffsetSurface(Surface=join_11.Breps, Distance=abdeckung_dach_dicke, BothSides=0, CreateSolid=True)
frame_preview_color_54 = ColourSwatch(SwatchColor=RGB(189, 189, 189))
data_61 = Data(offsrf_3)
preview_38 = CustomPreview(Geometry=data_61, Material=frame_preview_color_54)

# ---- group: Dachziegel / Dachziegel Geo
x_size = Slider(0.2, range=0..1)
number_slider_6 = Slider(0.35, range=0..1)
offset_32 = Slider(0.013, range=0..1)
dom_3 = ConstructDomain(DomainStart=expr("-x/2", x_size), DomainEnd=expr("x/2", x_size))
planesrf = PlaneSurface(Plane=PlaneXY(0, 0, 0), XSize=dom_3, YSize=number_slider_6)
Z_89 = UnitZ(Factor=offset_32)
move_55 = Move(Geometry=planesrf, Motion=Z_89)  # -> Geometry, Transform
yz = YZPlane(Origin=Point(0, 0, 0))
rotate_3 = Rotate(Geometry=move_55.Geometry, Angle=degrees(Slider(4, range=0..15)), Plane=yz)  # -> Geometry, Transform
loft_4 = Loft(
    Curves=[planesrf, rotate_3.Geometry],
    Options={Adjust=False, Closed=False, LoftEnds=0, LoftSimp=0, LoftType=0, Rebuild=10, Refit=0.01})
join_12 = BrepJoin(Breps=[planesrf, loft_4, rotate_3.Geometry])  # -> Breps, Closed
rotate_4 = Rotate(Geometry=join_12.Breps, Angle=expr("-x", degrees(Slider(4, range=0..15))), Plane=yz)  # -> Geometry, Transform

# ---- group: Dachaufbau
brep_6 = Brep(join_9.Breps)
dicke_aufsparrendämmung = Slider(0.1, range=0..0.1)
dicke_vorverdeckung = Slider(0.005, range=0.001..0.1)
dicke_unterspannbahn = Slider(0.005, range=0.001..0.1)
ma_8 = MassAddition(Input=[dicke_unterspannbahn, dicke_aufsparrendämmung, dicke_vorverdeckung])  # -> Result, PartialResults
Z_90 = UnitZ(Factor=dicke_aufsparrendämmung)
Z_91 = UnitZ(Factor=dicke_unterspannbahn)
Z_92 = UnitZ(Factor=dicke_vorverdeckung)
move_56 = Move(Geometry=brep_6, Motion=Z_91)  # -> Geometry, Transform
move_57 = Move(Geometry=move_56.Geometry, Motion=Z_90)  # -> Geometry, Transform
extr_60 = Extrude(Base=move_57.Geometry, Direction=Z_92)
extr_61 = Extrude(Base=brep_6, Direction=Z_91)
extr_62 = Extrude(Base=move_56.Geometry, Direction=Z_90)
frame_preview_color_55 = ColourSwatch(SwatchColor=RGB(31, 108, 143))
frame_preview_color_56 = ColourSwatch(SwatchColor=RGB(0, 0, 0))
frame_preview_color_57 = ColourSwatch(SwatchColor=RGB(252, 220, 56))
frame_preview_color_58 = ColourSwatch(SwatchColor=RGB(143, 78, 31))
preview_39 = CustomPreview(Geometry=extr_61, Material=frame_preview_color_55)
preview_40 = CustomPreview(Geometry=extr_60, Material=frame_preview_color_56)
preview_41 = CustomPreview(Geometry=extr_62, Material=frame_preview_color_57)

# ---- group: Dachaufbau / Konterlattung
num_92 = Number(num_10)
Z_93 = UnitZ(Factor=ma_8.Result)
Z_94 = UnitZ(Factor=num_92)

# ---- group: Zwischensparrendämmung und Cutoff für Dämmung
panel_358 = Panel("Höhe Dachpfetten")
brep_7 = Brep(join_9.Breps)
panel_359 = Panel("""Extrusion Pfette &
Dachbalken""")
frame_preview_color_59 = ColourSwatch(SwatchColor=RGB(163, 158, 131))

# ---- group: Dachlatten
# Output Wand Kurve Grundriss
brep_8 = Brep(graft(roof_2))
panel_360 = Panel("Raumhöhe Vektor")
crv_45 = Curve(data_37)
move_58 = Move(Geometry=crv_45, Motion=Z_80)  # -> Geometry, Transform
edges_11 = BrepEdges(Brep=move_58.Geometry)  # -> Naked, Interior, NonManifold
len_6 = Length(Curve=edges_11.Naked)
divide_3 = DivideCurve(Curve=edges_11.Naked, Count=len_6, Kinks=False)  # -> Points, Tangents, Parameters
item_7 = ListItem(List=divide_3.Points, Index="0", Wrap=True)
item_8 = ListItem(List=divide_3.Points, Index="0", Wrap=True)
item_9 = ListItem(List=divide_3.Tangents, Index="0", Wrap=True)
dist_3 = Distance(PointA=item_8, PointB=divide_3.Points)
bnd_7 = Bounds(Numbers=dist_3)
dedom2num_3 = DeconstructDomain²(Domain=bnd_7)  # -> UMin, UMax, VMin, VMax
subtraction_15 = Subtraction(A=dedom2num_3.UMax, B=num_10)
dom_4 = ConstructDomain(DomainStart=0, DomainEnd=subtraction_15)
remap_3 = RemapNumbers(Value=dist_3, Source=bnd_7, Target=dom_4)  # -> Mapped, Clipped
item_10 = ListItem(List=remap_3.Mapped, Index="1", Wrap=True)
contour = Contour(Shape=brep_8, Point=item_7, Direction=item_9, Distance=item_10)
eval_4 = EvaluateCurve(Curve=contour, Parameter="0")  # -> Point, Tangent, Angle
pdecon_2 = Deconstruct(Point=eval_4.Tangent)  # -> XComponent, YComponent, ZComponent
rad_4 = Radians(Degrees="270")
xy_3 = XYPlane(Origin=Point(0, 0, 0))
vec_10 = VectorXYZ(XComponent=pdecon_2.XComponent, YComponent=pdecon_2.YComponent, ZComponent=0)  # -> Vector, Length
höhe_dachpfetten = Slider(0.2, range=0.1..1)
rotate_5 = Rotate(Geometry=vec_10.Vector, Angle=rad_4, Plane=xy_3)  # -> Geometry, Transform
multiplication_29 = Multiplication(A=num_10, B=rotate_5.Geometry)
Z_95 = UnitZ(Factor=höhe_dachpfetten)
neg_25 = Negative(Value=Z_95)
extr_63 = Extrude(Base=contour, Direction=multiplication_29)
extr_64 = Extrude(Base=extr_63, Direction=neg_25)
panel_363 = Panel("Sdiff Dachbalken")
fastsdiff_21 = FastSolidDifference(
    SubtractFrom=extr_64,
    SubtractWith=graft(fastsdiff_20),
    Tolerance=0.01,
    computeBBFastSolidDiff=True,
    retainFastSolidDiff=True,
    strictFastSolidDiff=True,
    trueIntFastSolidDiff=False)
panel_364 = Panel("Abzug Ringbalken Dachbalken")
frame_preview_color_60 = ColourSwatch(SwatchColor=RGB(143, 78, 31))

# ---- group: Zwischensparrendämmung und Cutoff für Dämmung (continued)
Z_96 = UnitZ(Factor=höhe_dachpfetten)
neg_26 = Negative(Value=Z_96)
move_59 = Move(Geometry=brep_7, Motion=neg_26)  # -> Geometry, Transform
extr_65 = Extrude(Base=brep_7, Direction=neg_26)
fastsunion_2 = FastSolidUnion(Breps=flatten([fastsunion, extr_64]), Tolerance=0.01, strictFastSolidUnion=True, trueIntFastSolidUnion=False)  # -> graft(Result)
fastsdiff_22 = FastSolidDifference(
    SubtractFrom=extr_65,
    SubtractWith=fastsunion_2,
    Tolerance=0.01,
    computeBBFastSolidDiff=True,
    retainFastSolidDiff=True,
    strictFastSolidDiff=True,
    trueIntFastSolidDiff=False)
preview_42 = CustomPreview(Geometry=fastsdiff_22, Material=frame_preview_color_59)

# ----
dach_brep_unterseite = Brep(move_59.Geometry)
dach_brep_unterseite_2 = Brep(move_59.Geometry)
fastsint = FastSolidIntersect(
    FirstBrepSet=dach_brep_unterseite_2,
    SecondBrepSet=join_5.Breps,
    Tolerance=0.01,
    strictFastSolidInt=True,
    trueIntFastSolidInt=False)
fastsdiff_23 = FastSolidDifference(
    SubtractFrom=graft(join_5.Breps),
    SubtractWith=fastsint,
    Tolerance=0.01,
    computeBBFastSolidDiff=True,
    retainFastSolidDiff=True,
    strictFastSolidDiff=True,
    trueIntFastSolidDiff=False)
data_62 = Data([join_6.Breps, fastsdiff_23])
fastsdiff_24 = FastSolidDifference(
    SubtractFrom=data_62,
    SubtractWith=boxrec,
    Tolerance=0.01,
    computeBBFastSolidDiff=True,
    retainFastSolidDiff=True,
    strictFastSolidDiff=True,
    trueIntFastSolidDiff=False)
preview_43 = CustomPreview(Geometry=fastsdiff_24, Material=frame_preview_color_8)
bcx = BrepCurve(Brep=dach_brep_unterseite_2, Curve=line, UseTasks=False)  # -> Curves, flatten(Points)
bcx_2 = BrepCurve(Brep=dach_brep_unterseite_2, Curve=line_2, UseTasks=False)  # -> Curves, flatten(Points)
dist_4 = Distance(PointA=midpt_3, PointB=bcx.Points)
dist_5 = Distance(PointA=midpt_5, PointB=bcx_2.Points)
bnd_8 = Bounds(Numbers=dist_4)
bnd_9 = Bounds(Numbers=dist_5)
fastsint_2 = FastSolidIntersect(
    FirstBrepSet=dach_brep_unterseite_2,
    SecondBrepSet=extr_9,
    Tolerance=0.01,
    strictFastSolidInt=True,
    trueIntFastSolidInt=False)
dedomain_5 = DeconstructDomain(Domain=bnd_9)  # -> Start, End
Z_97 = UnitZ(Factor=dedomain_5.Start)
dedomain_6 = DeconstructDomain(Domain=bnd_8)  # -> Start, End
bcx_3 = BrepCurve(Brep=dach_brep_unterseite, Curve=line_3, UseTasks=False)  # -> Curves, Points
fastsint_3 = FastSolidIntersect(
    FirstBrepSet=dach_brep_unterseite_2,
    SecondBrepSet=extr_11,
    Tolerance=0.01,
    strictFastSolidInt=True,
    trueIntFastSolidInt=False)
dispatch_46 = Dispatch(List=Z_97, DispatchPattern=switch_flach_walmdach)  # -> ListA, ListB
fastsint_4 = FastSolidIntersect(
    FirstBrepSet=dach_brep_unterseite_2,
    SecondBrepSet=extr_13,
    Tolerance=0.01,
    strictFastSolidInt=True,
    trueIntFastSolidInt=False)
fastsint_5 = FastSolidIntersect(
    FirstBrepSet=dach_brep_unterseite_2,
    SecondBrepSet=extr_12,
    Tolerance=0.01,
    strictFastSolidInt=True,
    trueIntFastSolidInt=False)
fastsint_6 = FastSolidIntersect(
    FirstBrepSet=dach_brep_unterseite_2,
    SecondBrepSet=extr_14,
    Tolerance=0.01,
    strictFastSolidInt=True,
    trueIntFastSolidInt=False)
fastsdiff_25 = FastSolidDifference(
    SubtractFrom=graft(extr_9),
    SubtractWith=fastsint_2,
    Tolerance=0.01,
    computeBBFastSolidDiff=True,
    retainFastSolidDiff=True,
    strictFastSolidDiff=True,
    trueIntFastSolidDiff=False)
fastsint_7 = FastSolidIntersect(
    FirstBrepSet=dach_brep_unterseite_2,
    SecondBrepSet=extr_15,
    Tolerance=0.01,
    strictFastSolidInt=True,
    trueIntFastSolidInt=False)
trim_8 = TrimTree(Tree=bcx_3.Points, Depth=1)
fastsint_8 = FastSolidIntersect(
    FirstBrepSet=dach_brep_unterseite_2,
    SecondBrepSet=extr_16,
    Tolerance=0.01,
    strictFastSolidInt=True,
    trueIntFastSolidInt=False)
subtraction_16 = Subtraction(A=dedomain_6.Start, B=dedomain_5.Start)
fastsdiff_26 = FastSolidDifference(
    SubtractFrom=graft(extr_11),
    SubtractWith=fastsint_3,
    Tolerance=0.01,
    computeBBFastSolidDiff=True,
    retainFastSolidDiff=True,
    strictFastSolidDiff=True,
    trueIntFastSolidDiff=False)
Z_98 = UnitZ(Factor=dedomain_5.Start)
fastsdiff_27 = FastSolidDifference(
    SubtractFrom=graft(extr_13),
    SubtractWith=fastsint_4,
    Tolerance=0.01,
    computeBBFastSolidDiff=True,
    retainFastSolidDiff=True,
    strictFastSolidDiff=True,
    trueIntFastSolidDiff=False)
fastsdiff_28 = FastSolidDifference(
    SubtractFrom=graft(extr_12),
    SubtractWith=fastsint_5,
    Tolerance=0.01,
    computeBBFastSolidDiff=True,
    retainFastSolidDiff=True,
    strictFastSolidDiff=True,
    trueIntFastSolidDiff=False)
fastsdiff_29 = FastSolidDifference(
    SubtractFrom=graft(extr_14),
    SubtractWith=fastsint_6,
    Tolerance=0.01,
    computeBBFastSolidDiff=True,
    retainFastSolidDiff=True,
    strictFastSolidDiff=True,
    trueIntFastSolidDiff=False)
fastsdiff_30 = FastSolidDifference(
    SubtractFrom=graft(extr_15),
    SubtractWith=fastsint_7,
    Tolerance=0.01,
    computeBBFastSolidDiff=True,
    retainFastSolidDiff=True,
    strictFastSolidDiff=True,
    trueIntFastSolidDiff=False)
dist_6 = Distance(PointA=trim_8, PointB=midpt_4)
fastsint_9 = FastSolidIntersect(
    FirstBrepSet=dach_brep_unterseite_2,
    SecondBrepSet=extr_20,
    Tolerance=0.01,
    strictFastSolidInt=True,
    trueIntFastSolidInt=False)
fastsdiff_31 = FastSolidDifference(
    SubtractFrom=graft(extr_16),
    SubtractWith=fastsint_8,
    Tolerance=0.01,
    computeBBFastSolidDiff=True,
    retainFastSolidDiff=True,
    strictFastSolidDiff=True,
    trueIntFastSolidDiff=False)
extr_66 = Extrude(Base=boundary_10, Direction=[dispatch_25.ListA, dispatch_46.ListB])
move_60 = Move(Geometry=boundary_10, Motion=Z_98)  # -> Geometry, Transform
fastsdiff_32 = FastSolidDifference(
    SubtractFrom=graft(fastsdiff_25),
    SubtractWith=data_26,
    Tolerance=0.01,
    computeBBFastSolidDiff=True,
    retainFastSolidDiff=True,
    strictFastSolidDiff=True,
    trueIntFastSolidDiff=False)
Z_99 = UnitZ(Factor=subtraction_16)
fastsint_10 = FastSolidIntersect(
    FirstBrepSet=dach_brep_unterseite_2,
    SecondBrepSet=extr_21,
    Tolerance=0.01,
    strictFastSolidInt=True,
    trueIntFastSolidInt=False)
bnd_10 = Bounds(Numbers=dist_6)
fastsdiff_33 = FastSolidDifference(
    SubtractFrom=graft(fastsdiff_26),
    SubtractWith=data_26,
    Tolerance=0.01,
    computeBBFastSolidDiff=True,
    retainFastSolidDiff=True,
    strictFastSolidDiff=True,
    trueIntFastSolidDiff=False)
fastsdiff_34 = FastSolidDifference(
    SubtractFrom=graft(extr_20),
    SubtractWith=fastsint_9,
    Tolerance=0.01,
    computeBBFastSolidDiff=True,
    retainFastSolidDiff=True,
    strictFastSolidDiff=True,
    trueIntFastSolidDiff=False)
fastsdiff_35 = FastSolidDifference(
    SubtractFrom=graft(fastsdiff_29),
    SubtractWith=data_26,
    Tolerance=0.01,
    computeBBFastSolidDiff=True,
    retainFastSolidDiff=True,
    strictFastSolidDiff=True,
    trueIntFastSolidDiff=False)
preview_44 = CustomPreview(Geometry=[fastsdiff_32, fastsdiff_2], Material=frame_preview_color_11)
bcx_4 = BrepCurve(Brep=dach_brep_unterseite, Curve=line_4, UseTasks=False)  # -> Curves, flatten(Points)
extr_67 = Extrude(Base=move_60.Geometry, Direction=Z_99)
bcx_5 = BrepCurve(Brep=dach_brep_unterseite, Curve=line_5, UseTasks=False)  # -> Curves, flatten(Points)
fastsdiff_36 = FastSolidDifference(
    SubtractFrom=graft(fastsdiff_27),
    SubtractWith=data_26,
    Tolerance=0.01,
    computeBBFastSolidDiff=True,
    retainFastSolidDiff=True,
    strictFastSolidDiff=True,
    trueIntFastSolidDiff=False)
fastsdiff_37 = FastSolidDifference(
    SubtractFrom=graft(fastsdiff_28),
    SubtractWith=data_26,
    Tolerance=0.01,
    computeBBFastSolidDiff=True,
    retainFastSolidDiff=True,
    strictFastSolidDiff=True,
    trueIntFastSolidDiff=False)
dedomain_7 = DeconstructDomain(Domain=bnd_10)  # -> Start, End
fastsdiff_38 = FastSolidDifference(
    SubtractFrom=graft(extr_21),
    SubtractWith=fastsint_10,
    Tolerance=0.01,
    computeBBFastSolidDiff=True,
    retainFastSolidDiff=True,
    strictFastSolidDiff=True,
    trueIntFastSolidDiff=False)
fastsdiff_39 = FastSolidDifference(
    SubtractFrom=graft(fastsdiff_30),
    SubtractWith=data_26,
    Tolerance=0.01,
    computeBBFastSolidDiff=True,
    retainFastSolidDiff=True,
    strictFastSolidDiff=True,
    trueIntFastSolidDiff=False)
fastsdiff_40 = FastSolidDifference(
    SubtractFrom=graft(extr_66),
    SubtractWith=data_26,
    Tolerance=0.01,
    computeBBFastSolidDiff=True,
    retainFastSolidDiff=True,
    strictFastSolidDiff=True,
    trueIntFastSolidDiff=False)
fastsdiff_41 = FastSolidDifference(
    SubtractFrom=graft(fastsdiff_31),
    SubtractWith=data_26,
    Tolerance=0.01,
    computeBBFastSolidDiff=True,
    retainFastSolidDiff=True,
    strictFastSolidDiff=True,
    trueIntFastSolidDiff=False)
dist_7 = Distance(PointA=midpt_6, PointB=bcx_4.Points)
dist_8 = Distance(PointA=midpt_7, PointB=bcx_5.Points)
preview_45 = CustomPreview(Geometry=[fastsdiff_6, fastsdiff_33], Material=frame_preview_color_12)
preview_46 = CustomPreview(Geometry=[fastsdiff_3, fastsdiff_35], Material=frame_preview_color_13)
dispatch_47 = Dispatch(List=dedomain_7.Start, DispatchPattern=switch_flach_walmdach)  # -> ListA, ListB
preview_47 = CustomPreview(Geometry=fastsdiff_40, Material=frame_preview_color_14)
fastsdiff_42 = FastSolidDifference(
    SubtractFrom=graft(extr_67),
    SubtractWith=data_26,
    Tolerance=0.01,
    computeBBFastSolidDiff=True,
    retainFastSolidDiff=True,
    strictFastSolidDiff=True,
    trueIntFastSolidDiff=False)
preview_48 = CustomPreview(Geometry=[fastsdiff_37, fastsdiff_4], Material=frame_preview_color_15)
fastsdiff_43 = FastSolidDifference(
    SubtractFrom=graft(fastsdiff_34),
    SubtractWith=data_26,
    Tolerance=0.01,
    computeBBFastSolidDiff=True,
    retainFastSolidDiff=True,
    strictFastSolidDiff=True,
    trueIntFastSolidDiff=False)
bnd_11 = Bounds(Numbers=dist_7)
bnd_12 = Bounds(Numbers=dist_8)
preview_49 = CustomPreview(Geometry=[fastsdiff_39, fastsdiff_7], Material=frame_preview_color_17)
fastsdiff_44 = FastSolidDifference(
    SubtractFrom=graft(fastsdiff_38),
    SubtractWith=data_26,
    Tolerance=0.01,
    computeBBFastSolidDiff=True,
    retainFastSolidDiff=True,
    strictFastSolidDiff=True,
    trueIntFastSolidDiff=False)
preview_50 = CustomPreview(Geometry=[fastsdiff_41, fastsdiff_9], Material=frame_preview_color_18)
preview_51 = CustomPreview(Geometry=[fastsdiff_5, fastsdiff_36], Material=frame_preview_color_16)
dedomain_8 = DeconstructDomain(Domain=bnd_11)  # -> Start, End
dedomain_9 = DeconstructDomain(Domain=bnd_12)  # -> Start, End
preview_52 = CustomPreview(Geometry=fastsdiff_42, Material=frame_preview_color_19)
preview_53 = CustomPreview(Geometry=[fastsdiff_10, fastsdiff_43], Material=frame_preview_color_20)
Z_100 = UnitZ(Factor=dispatch_47.ListB)
preview_54 = CustomPreview(Geometry=[fastsdiff_44, fastsdiff_8], Material=frame_preview_color_21)
subtraction_17 = Subtraction(A=dedomain_8.Start, B=dedomain_9.Start)
# Extrusions höhe Dämmung minus Ringbalken höhe
subtraction_18 = Subtraction(A=dedomain_8.Start, B=subtraction_17)
Z_101 = UnitZ(Factor=subtraction_18)
Z_102 = UnitZ(Factor=dedomain_9.Start)
Z_103 = UnitZ(Factor=dedomain_9.Start)
dispatch_48 = Dispatch(List=Z_101, DispatchPattern=switch_flach_walmdach)  # -> ListA, ListB
move_61 = Move(Geometry=boundary_12, Motion=Z_102)  # -> Geometry, Transform
Z_104 = UnitZ(Factor=subtraction_17)
dispatch_49 = Dispatch(List=Z_103, DispatchPattern=switch_flach_walmdach)  # -> ListA, ListB
extr_68 = Extrude(Base=move_22.Geometry, Direction=dispatch_48.ListB)
extr_69 = Extrude(Base=move_61.Geometry, Direction=Z_104)
cap_6 = CapHoles(Brep=extr_68)
extr_70 = Extrude(Base=boundary_12, Direction=dispatch_49.ListB)
fastsdiff_45 = FastSolidDifference(
    SubtractFrom=graft(extr_69),
    SubtractWith=data_26,
    Tolerance=0.01,
    computeBBFastSolidDiff=True,
    retainFastSolidDiff=True,
    strictFastSolidDiff=True,
    trueIntFastSolidDiff=False)
fastsdiff_46 = FastSolidDifference(
    SubtractFrom=graft(cap_6),
    SubtractWith=data_26,
    Tolerance=0.01,
    UseTasks=False,
    computeBBFastSolidDiff=True,
    retainFastSolidDiff=True,
    strictFastSolidDiff=True,
    trueIntFastSolidDiff=False)
preview_55 = CustomPreview(Geometry=fastsdiff_45, Material=frame_preview_color_22)
extr_71 = Extrude(Base=move_23.Geometry, Direction=Z_100)
cap_7 = CapHoles(Brep=extr_71)
data_63 = Data([fastsdiff_46, fastsdiff_11])
fastsdiff_47 = FastSolidDifference(
    SubtractFrom=extr_70,
    SubtractWith=data_63,
    Tolerance=0.01,
    computeBBFastSolidDiff=True,
    retainFastSolidDiff=True,
    strictFastSolidDiff=True,
    trueIntFastSolidDiff=False)
fastsdiff_48 = FastSolidDifference(
    SubtractFrom=graft(fastsdiff_47),
    SubtractWith=data_26,
    Tolerance=0.01,
    computeBBFastSolidDiff=True,
    retainFastSolidDiff=True,
    strictFastSolidDiff=True,
    trueIntFastSolidDiff=False)
preview_56 = CustomPreview(Geometry=[fastsdiff_12, fastsdiff_48], Material=frame_preview_color_23)
preview_57 = CustomPreview(Geometry=data_63, Material=frame_preview_color_24)
fastsdiff_49 = FastSolidDifference(
    SubtractFrom=graft(cap_7),
    SubtractWith=data_26,
    Tolerance=0.01,
    computeBBFastSolidDiff=True,
    retainFastSolidDiff=True,
    strictFastSolidDiff=True,
    trueIntFastSolidDiff=False)
data_64 = Data(fastsdiff_49)
preview_58 = CustomPreview(Geometry=data_64, Material=frame_preview_color_26)

# ---- group: Dachaufbau / Konterlattung (continued)
move_62 = Move(Geometry=extr_63, Motion=Z_93)  # -> Geometry, Transform
konterlattung = Extrude(Base=move_62.Geometry, Direction=Z_94)

# ---- group: Dachaufbau (continued)
ma_9 = MassAddition(Input=[ma_8.Result, num_92])  # -> Result, PartialResults
Z_105 = UnitZ(Factor=ma_9.Result)
move_63 = Move(Geometry=brep_6, Motion=Z_105)  # -> Geometry, Transform
preview_59 = CustomPreview(Geometry=konterlattung, Material=frame_preview_color_58)

# ----
addition_20 = Addition(A=ma_9.Result, B=höhe_dachpfetten)  # disabled
neg_27 = Negative(Value=addition_20)  # disabled
Z_106 = UnitZ(Factor=neg_27)  # disabled

# ---- group: Dachlatten (continued)
fastsdiff_50 = FastSolidDifference(
    SubtractFrom=fastsdiff_21,
    SubtractWith=extr_67,
    Tolerance=0.01,
    computeBBFastSolidDiff=True,
    retainFastSolidDiff=True,
    strictFastSolidDiff=True,
    trueIntFastSolidDiff=False)
preview_60 = CustomPreview(Geometry=fastsdiff_50, Material=frame_preview_color_60)

# ---- group: Dachlattung
edges_12 = BrepEdges(Brep=move_63.Geometry)  # -> Naked, Interior, NonManifold
debrep_3 = DeconstructBrep(Brep=move_63.Geometry)  # -> Faces, Edges, Vertices
join_13 = JoinCurves(Curves=edges_12.Naked, Preserve=False)
crv_46 = Curve(join_13)
eval_5 = EvaluateCurve(Curve=reparameterize(crv_46), Parameter="0")  # -> Point, Tangent, Angle
dachlattung_dimensionen = Slider(0.06, range=0..0.1)
Z_107 = UnitZ(Factor=1)
brep_9 = Brep(graft(debrep_3.Faces))
md_slider_5 = MDSlider(SliderMode=0, slider_value=Point(0.5, 0.5, 0.5), x_domain=Domain(0, 1), y_domain=Domain(0, 1), z_domain=Domain(0, 1))
trim_9 = TrimTree(Tree=contour, Depth=1)
evalsrf_5 = EvaluateSurface(Surface=reparameterize(brep_9), Point=md_slider_5)  # -> Point, Normal, UDirection, VDirection, Frame
eval_6 = EvaluateCurve(Curve=reparameterize(trim_9), Parameter="0")  # -> Point, Tangent, Angle
neg_28 = Negative(Value=evalsrf_5.Normal)
unit = UnitVector(Vector=eval_6.Tangent)
multiplication_30 = Multiplication(A=neg_28, B=dachlattung_dimensionen)
multiplication_31 = Multiplication(A=unit, B=dachlattung_dimensionen)
frame_preview_color_61 = ColourSwatch(SwatchColor=RGB(143, 78, 31))

# ---- group: Dachziegel
brep_10 = Brep(move_63.Geometry)
crv_47 = Curve(contour)
trim_10 = TrimTree(Tree=crv_47, Depth=1)
len_7 = Length(Curve=trim_10)
bnd_13 = Bounds(Numbers=len_7)
dedomain_10 = DeconstructDomain(Domain=bnd_13)  # -> Start, End
multiplication_32 = Multiplication(A=dedomain_10.End, B=Slider(5, range=0..10))
num_93 = Number(number_slider_6)
num_94 = Number(x_size)
division_4 = Division(A=multiplication_32, B=num_94)
round = Round(Number=division_4)  # -> Nearest, Floor, Ceiling

# ---- group: Dachlattung (continued)
contour_2 = Contour(Shape=debrep_3.Faces, Point=eval_5.Point, Direction=Z_107, Distance=num_94)
trim_11 = TrimTree(Tree=contour_2, Depth=1)
extr_72 = Extrude(Base=trim_11, Direction=multiplication_30)
extr_73 = Extrude(Base=extr_72, Direction=multiplication_31)
cull_i = CullIndex(List=extr_73, Indices="0", Wrap=True)
preview_61 = CustomPreview(Geometry=cull_i, Material=frame_preview_color_61)

# ---- group: Dachziegel (continued)
item_11 = ListItem(List=extr_73, Index="0", Wrap=True)
bbox_2 = BoundingBox(Content=item_11, Plane=PlaneXY(0, 0, 0), UnionBox=False)  # -> Box, Box_2
debox_2 = DeconstructBox(Box=bbox_2.Box)  # -> Plane, X, Y, Z
num_95 = Number(debox_2.Z)
avr = Average(Input=flatten(num_95))

# ---- group: Dachziegel / Abstand Latte und Deckung
multiplication_33 = Multiplication(A=avr, B=Slider(1.5, range=0..10))

# ---- group: Dachziegel (continued)
panel_365 = Panel(multiplication_33)
Z_108 = UnitZ(Factor=multiplication_33)
move_64 = Move(Geometry=brep_10, Motion=Z_108)  # -> Geometry, Transform
brep_11 = Brep(move_64.Geometry)
debrep_4 = DeconstructBrep(Brep=move_64.Geometry)  # -> Faces, Edges, Vertices
edges_13 = BrepEdges(Brep=brep_11)  # -> Naked, Interior, NonManifold
pframe = PerpFrame(Curve=reparameterize(edges_13.Naked), Parameter="0.5")
eval_7 = EvaluateCurve(Curve=reparameterize(edges_13.Naked), Parameter="0")  # -> Point, Tangent, Angle
len_8 = Length(Curve=edges_13.Naked)
cir = Circle(Plane=pframe, Radius=Slider(0.1, range=0..1))
eval_8 = EvaluateCurve(Curve=reparameterize(edges_13.Naked), Parameter="0.5")  # -> Point, Tangent, Angle
bcx_6 = BrepCurve(Brep=brep_11, Curve=cir)  # -> Curves, Points
multiplication_34 = Multiplication(A=len_8, B=Slider(6, range=0..10))
trim_12 = TrimTree(Tree=bcx_6.Points, Depth=1)
multiplication_35 = Multiplication(A=len_8, B="0.5")
vec2pt = Vector2Pt(PointA=eval_8.Point, PointB=trim_12, Unitize=False)  # -> Vector, Length
rev_3 = Reverse(Vector=eval_7.Tangent)
multiplication_36 = Multiplication(A=rev_3, B=multiplication_35)
move_65 = Move(Geometry=eval_7.Point, Motion=multiplication_36)  # -> Geometry, Transform
division_5 = Division(A=multiplication_34, B=num_93)
round_2 = Round(Number=division_5)  # -> Nearest, Floor, Ceiling
ptplanar = PlanarGrid(
    BasePoint=move_65.Geometry,
    IDir=eval_7.Tangent,
    JDir=vec2pt.Vector,
    IDistance=num_93,
    JDistance=num_94,
    INumber=round.Nearest,
    JNumber=round_2.Nearest)

# ----
brep_12 = Brep(move_64.Geometry)  # disabled
extr_74 = Extrude(Base=brep_12, Direction=Z_106)  # disabled
debrep_5 = DeconstructBrep(Brep=brep_12)  # -> Faces, Edges, Vertices; disabled
flip_2 = Flip(Surface=debrep_5.Faces)  # -> Surface, Result; disabled
tof = Ladybug_TiltAndOrientationFactor(
    epwFile=downloadepw.epw_file,
    PV_SWHsurface=flip_2.Surface,
    annualShading=0,
    north=0,
    precision=2,
    scale=1,
    bakeIt=False,
    runIt=toggle)  # -> readMe, port, TOF, TSRF, PVsurfaceTilt, PVsurfaceAzimuth, optimalTilt, optimalAzimuth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; disabled; plug-in component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
panel_366 = Panel(tof.optimalAzimuth)  # disabled
panel_367 = Panel(tof.optimalTilt)  # disabled
panel_368 = Panel(tof.optimalRadiation)  # disabled
incidentradiation = LBIncidentRadiation(
    sky_mtx=skymatrix.sky_mtx,
    geometry=flatten(fenster_generator_3.G),
    context=flatten([extr_74, fastsdiff_35]),
    grid_size=number_slider_5,
    run=toggle_2)  # -> report, points, results, total, mesh, legend, title, int_mtx; disabled; plug-in component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
panel_369 = Panel(incidentradiation.results)  # disabled
panel_370 = Panel(incidentradiation.total)  # disabled

# ---- group: Dachziegel / Ziegel, Performance Turnoff
pttrim = TrimGrid(Grid=ptplanar, BRep=debrep_4.Faces)  # disabled
ptorient = OrientToGrid(Grid=pttrim, PatternObjects=rotate_4.Geometry, Shift_i=1, Shift_j=1, Rigid=False, Flip=False)  # disabled
frame_preview_color_62 = ColourSwatch(SwatchColor=RGB(143, 89, 31))  # disabled
group = Group(Objects=ptorient)  # disabled
preview_62 = CustomPreview(Geometry=ptorient, Material=frame_preview_color_62)  # disabled

# ---- group: Schürzen
panel_371 = Panel("Joined Brep Dach")
edges_14 = BrepEdges(Brep=join_9.Breps)  # -> Naked, Interior, NonManifold
move_66 = Move(Geometry=edges_14.Naked, Motion=neg_26)  # -> Geometry, Transform
crv_48 = Curve(move_66.Geometry)
join_14 = JoinCurves(Curves=crv_48, Preserve=False)

# ---- group: Kantenabdeckung
brep_13 = Brep(move_64.Geometry)
Z_109 = UnitZ(Factor=Slider(0.035, range=0..1))
number_slider_7 = Slider(0.01, range=0..0.1)
move_67 = Move(Geometry=brep_13, Motion=Z_109)  # -> Geometry, Transform
sqr = Square(Value=x_size)
sqr_2 = Square(Value=number_slider_6)
edges_15 = BrepEdges(Brep=move_67.Geometry)  # -> Naked, Interior, NonManifold
Z_110 = UnitZ(Factor=number_slider_7)
addition_21 = Addition(A=sqr, B=sqr_2)
crv_49 = Curve(edges_15.Interior)
extr_75 = Extrude(Base=move_67.Geometry, Direction=Z_110)
sqrt = SquareRoot(Value=addition_21)
pipe = Pipe(Curve=crv_49, Radius=sqrt, Caps=Slider(2, range=0..10))
frame_preview_color_63 = ColourSwatch(SwatchColor=RGB(168, 168, 168))
fastsint_11 = FastSolidIntersect(
    FirstBrepSet=graft(pipe),
    SecondBrepSet=flatten(extr_75),
    Tolerance=0.01,
    strictFastSolidInt=True,
    trueIntFastSolidInt=False)

# ---- group: Schürzen (continued)
crv_50 = Curve(edges_15.Naked)
Z_111 = UnitZ(Factor=number_slider_7)
move_68 = Move(Geometry=crv_50, Motion=Z_111)  # -> Geometry, Transform
join_15 = JoinCurves(Curves=move_68.Geometry, Preserve=False)
loft_5 = Loft(
    Curves=[join_15, join_14],
    Options={Adjust=False, Closed=False, LoftEnds=0, LoftSimp=0, LoftType=0, Rebuild=10, Refit=0.01})
flippsrf_2 = FlipPolysurface(Polysurface=loft_5)  # -> Flipped, R
offsrf_4 = OffsetSurface(Surface=flippsrf_2.Flipped, Distance=number_slider_7, BothSides=0, CreateSolid=True)

# ---- group: Kantenabdeckung (continued)
preview_63 = CustomPreview(Geometry=[fastsint_11, offsrf_4], Material=frame_preview_color_63)

# ==== cluster Cluster
wand = ClusterInput()
grundriss = ClusterInput()
wand_2 = Curve(wand)
grundriss_2 = Curve(grundriss)
snapping_edge = Slider(3, range=0..25)
eval = EvaluateCurve(Curve=reparameterize(grundriss_2), Parameter=".25")  # -> Point, Tangent, Angle
debrep = DeconstructBrep(Brep=wand_2)  # -> Faces, Edges, Vertices
panel = Panel(""".25
.75""")
pl = PlaneNormal(Origin=eval.Point, ZAxis=eval.Tangent)
eval_2 = EvaluateCurve(Curve=reparameterize(grundriss_2), Parameter=panel)  # -> Point, Tangent, Angle
item = ListItem(List=debrep.Vertices, Index=snapping_edge, Wrap=True)
A = ClusterInput()
crv_cp = CurveClosestPoint(Point=eval_2.Point, Curve=grundriss_2)  # -> Point, Parameter, Distance
pln = Plane(item)
rot3d = Rotate3D(Geometry=pl, Angle=degrees(A), Center=eval.Point, Axis=eval.Tangent)  # -> Geometry, Transform
shatter = Shatter(Curve=grundriss_2, Parameters=crv_cp.Parameter)
orient = Orient(Geometry=wand_2, Source=pln, Target=rot3d.Geometry)  # -> Geometry, Transform
swp1 = Sweep1(Rail=shatter, Sections=orient.Geometry, Miter=1)
join = BrepJoin(Breps=flatten(swp1))  # -> Breps, Closed
B = ClusterOutput(join.Breps)

# ==== cluster Cluster_2
crv = ClusterInput()
crv_2 = ClusterInput()
txt = ClusterInput()
txt_2 = ClusterInput()
brep = ClusterInput()
brep_2 = ClusterInput()
int = ClusterInput()

crv_3 = Curve(crv)
crv_4 = Curve(crv_2)

txt_3 = Text(txt)
txt_4 = Text(txt_2)
brep_3 = Brep(brep)
brep_4 = Brep(brep_2)
int_2 = Integer(int)
number_slider = Slider(0.139, range=0..10)
swatch = ColourSwatch(SwatchColor=RGB(0, 0, 0))
dash = DashPattern(Curve=crv_4, Pattern=[Slider(0.513, range=0..10), Slider(0.547, range=0..10)])  # -> Dashes, Gaps
previewlw = CustomPreviewLineweights(Geometry=dash.Dashes, Shader=swatch, Thickness=number_slider, Absolute=True)
previewlw_2 = CustomPreviewLineweights(Geometry=crv_3, Shader=swatch, Thickness=number_slider, Absolute=True)
txt_5 = Text(txt_4)
trim = TextTrim(Text=txt_3, Start=True, End=True)
len = TextLength(Text=txt_5)
min = Minimum(A="8", B=len)
fragment = TextFragment(Text=txt_5, Start="0", Count=min)
tmatch = MatchText(Text=fragment, Pattern="&&HALL&&", Case=True)
long = LongestList(ListA=tmatch, ListB="0", ListC="8", PaddingMode=2)  # -> ListA, ListB, ListC
brep_5 = Brep(brep_4)
brep_6 = Brep(brep_3)
p_n_c = PickNChoose(Pattern=tmatch, Stream0=long.ListB, Stream1=long.ListC)
fragment_2 = TextFragment(Text=txt_5, Start=p_n_c)
lng = ListLength(List=brep_6)
division = Division(A=".8", B=lng)
join = BrepJoin(Breps=flatten([brep_5, brep_6]))  # -> Breps, Closed
series = Series(Start=0, Step=division, Count=lng)
txt_6 = Text(fragment_2)
addition = Addition(A=series, B=Slider(0.704, range=0..1))
edges = BrepEdges(Brep=join.Breps)  # -> Naked, Interior, NonManifold
number_slider_2 = Slider(0.045, range=0..4)
crv_5 = Curve(edges.Naked)
area = Area(Geometry=brep_6)  # -> Area, Centroid
long_2 = LongestList(ListA=tmatch, ListB=Slider(0.656, range=0..1), ListC="1", PaddingMode=2)  # -> ListA, ListB, ListC
join_2 = JoinCurves(Curves=crv_5, Preserve=False)
crv_6 = Curve(simplify(brep_6))
p_n_c_2 = PickNChoose(Pattern=tmatch, Stream0=long_2.ListB, Stream1=long_2.ListC)
offset = Offset(Curve=flatten(join_2), Distance=expr("x/2", number_slider_2), Plane=PlaneXY(0, 0, 0), Corners=1)
screentext = ScreenOrientedText(Text=txt_6, Justification=7, Location=area.Centroid, SizeFactor=Slider(8, range=0..100), Depth=0, Absolute=False)
hsl = ColourHSL(Alpha=1, Hue=0, Saturation=0, Luminance=Slider(1, range=0..1))
hsl_2 = ColourHSL(Alpha=1, Hue=addition, Saturation=1, Luminance=p_n_c_2)
subtraction = Subtraction(A=hsl_2, B=ColourSwatch(SwatchColor=RGB(71, 71, 71)))  # -> simplify(Result)
previewmat = CustomPreviewMaterials(Geometry=brep_5, DiffuseColor=hsl)
previewlw_3 = CustomPreviewLineweights(Geometry=flatten(offset), Shader=ColourSwatch(SwatchColor=RGB(0, 0, 0)), Thickness=number_slider_2, Absolute=True)
previewlw_4 = CustomPreviewLineweights(Geometry=crv_6, Shader=subtraction, Thickness=Slider(0.069, range=0..4), Absolute=True)
previewmat_2 = CustomPreviewMaterials(Geometry=brep_6, DiffuseColor=hsl_2)

# ==== cluster FensterGenerator
kurven_himmelsrichtung = ClusterInput()
kurven_himmelsrichtung_2 = Curve(kurven_himmelsrichtung)
panel = Panel("Dicke Wandaufbau Innenände")
end = EndPoints(Curve=kurven_himmelsrichtung_2)  # -> Start, End
panel_2 = Panel("Punkte Innenwände")
panel_3 = Panel("Dicke Wandaufbau")
num = ClusterInput()
pt = ClusterInput()
num_2 = ClusterInput()
pt_2 = Point([end.Start, end.End])
num_3 = Number(num)
pt_3 = Point(pt)
num_4 = Number(num_2)
sph = Sphere(Base=pt_2, Radius=num_3)
sph_2 = Sphere(Base=pt_3, Radius=num_4)
data = Data(flatten([sph, sph_2]))
panel_4 = Panel("Augenhöhe")
trim = TrimWithBreps(Curve=kurven_himmelsrichtung_2, Brep=data)  # -> Inside, Outside
num_5 = ClusterInput()
mindestbreite_fenster = Slider(0.3, range=-0.3..0.7)
wwr_himmelsrichtung = ClusterInput()
panel_5 = Panel("Raumhöhe")
crv = Curve(trim.Outside)
num_6 = Number(num_5)
wwr_himmelsrichtung_2 = Number(wwr_himmelsrichtung)
num_7 = Number("1.6")
len = Length(Curve=crv)
subtraction = Subtraction(A=num_6, B=num_7)
graph = GraphMapper(wwr_himmelsrichtung_2, x0=0, x1=1, y0=0, y1=1, Gx=0.5, Gy=0.7071067812, Ox=0, Oy=0, container_name="Square Root")
graph_2 = GraphMapper(wwr_himmelsrichtung_2, x0=0, x1=1, y0=0, y1=1, Gx=0.5, Gy=0.7071067812, Ox=0, Oy=0, container_name="Square Root")
larger = LargerThan(FirstNumber=len, SecondNumber=mindestbreite_fenster)  # -> LargerThan, OrEqualTo
subtraction_2 = Subtraction(A=num_6, B=subtraction)
cull = CullPattern(List=crv, CullPattern=larger.LargerThan)
cull_2 = CullPattern(List=len, CullPattern=larger.LargerThan)
maximalbreite_fenster = Slider(2, range=0..10)
num_8 = Number(graph_2)
remap = RemapNumbers(Value=cull_2, Source=Domain(0, 1), Target=graph)  # -> Mapped, Clipped
graph_3 = GraphMapper(
    num_8,
    x0=0,
    x1=1,
    y0=0,
    y1=1,
    A=1,
    B=0,
    container_name="Linear",
    Graph_x0=0.25,
    Graph_x1=0.75,
    Graph_y0=0.25,
    Graph_y1=0.75)
graph_4 = GraphMapper(num_8, x0=0, x1=1, y0=0, y1=1, container_name="Bezier", cpx=[0, 0, 0, 1], cpy=[0, 0, 1, 1])
division = Division(A=remap.Mapped, B=maximalbreite_fenster)
round = Round(Number=division)  # -> Nearest, Floor, Ceiling
remap_2 = RemapNumbers(Value=subtraction_2, Source=Domain(0, 1), Target=graph_4)  # -> Mapped, Clipped
remap_3 = RemapNumbers(Value=subtraction, Source=Domain(0, 1), Target=graph_3)  # -> Mapped, Clipped
addition = Addition(A=remap_2.Mapped, B=remap_3.Mapped)
# Anzahl Fenster der Seite
anzahl_fenster_der_seite = Number(round.Ceiling)
panel_6 = Panel(round.Ceiling)
Z = UnitZ(Factor=remap_3.Mapped)
panel_7 = Panel("Einzelkurven der Himmelsrichtung")
division_2 = Division(A=remap.Mapped, B=round.Ceiling)
num_9 = Number(addition)
crv_2 = Curve(cull)
multiplication = Multiplication(A=num_9, B=remap.Mapped)
divide = DivideCurve(Curve=crv_2, Count=anzahl_fenster_der_seite, Kinks=False)  # -> Points, Tangents, Parameters
multiplication_2 = Multiplication(A=len, B=num_6)
shatter = Shatter(Curve=graft(crv_2), Parameters=divide.Parameters)
division_3 = Division(A=multiplication, B=multiplication_2)
midpt = CurveMiddle(Curve=shatter)
Z_2 = UnitZ(Factor=num_7)
wwr_actual = Number(division_3)
move = Move(Geometry=midpt, Motion=Z_2)  # -> Geometry, Transform
panel_9 = Panel(wwr_actual)
multiplication_3 = Multiplication(A=division_2, B=divide.Tangents)
panel_10 = Panel("WWR Actual")
Z_3 = UnitZ(Factor=1)
multiplication_4 = Multiplication(A="-0.5", B=multiplication_3)
move_2 = Move(Geometry=move.Geometry, Motion=multiplication_4)  # -> Geometry, Transform
extr = Extrude(Base=shatter, Direction=Z_3)
md_slider = MDSlider(SliderMode=0, slider_value=Point(0.5, 0.5, 0.5), x_domain=Domain(0, 1), y_domain=Domain(0, 1), z_domain=Domain(0, 1))
evalsrf = EvaluateSurface(Surface=reparameterize(extr), Point=md_slider)  # -> Point, Normal, UDirection, VDirection, Frame
vec = Vector(divide.Tangents)
pl = ConstructPlane(Origin=move_2.Geometry, XAxis=divide.Tangents, YAxis=evalsrf.Normal)
num_10 = ClusterInput()
panel_11 = Panel("Dicke Wandaufbau gesamt")
num_11 = Number(num_10)
rectangle = Rectangle(Plane=pl, XSize=division_2, YSize=num_11, Radius=0)  # -> Rectangle, Length
panel_12 = Panel("Höhe über Auenhöhe")
move_3 = Move(Geometry=rectangle.Rectangle, Motion=Z)  # -> Geometry, Transform
move_4 = Move(Geometry=move_2.Geometry, Motion=Z)  # -> Geometry, Transform
panel_13 = Panel("Höhe Fenster Gesamt")
clean = CleanTree(RemoveNulls=True, RemoveInvalid=True, RemoveEmpty=Toggle(True), Tree=move_3.Geometry)
neg = Negative(Value=num_9)
boxrec = BoxRectangle(Rectangle=clean, Height=neg)
B = ClusterOutput(boxrec)
panel_14 = Panel("Breite Fenster")
num_12 = Number(division_2)
item = ListItem(List=divide.Tangents, Index="1", Wrap=True)
multiplication_5 = Multiplication(A=num_12, B="0.5")
item_2 = ListItem(List=vec, Index="1", Wrap=True)
multiplication_6 = Multiplication(A=multiplication_5, B=item)
item_3 = ListItem(List=evalsrf.Normal, Index="1", Wrap=True)
move_5 = Move(Geometry=move_4.Geometry, Motion=multiplication_6)  # -> Geometry, Transform
vec_2 = Vector(item_2)
panel_17 = Panel("Fenster Höhe")
cullpt = CullDuplicates(Points=move_5.Geometry, Tolerance=0.1, CullMode=3)  # -> Points, Indices, Valence
multiplication_7 = Multiplication(A=vec_2, B=num_12)
num_13 = Number(num_9)
num_14 = Number(num_11)
pt_4 = Point(cullpt.Points)
neg_2 = Negative(Value=num_13)
multiplication_8 = Multiplication(A=item_3, B=num_14)
Z_4 = UnitZ(Factor=neg_2)
multiplication_9 = Multiplication(A=multiplication_7, B="0.5")
multiplication_10 = Multiplication(A=multiplication_7, B="-0.5")
panel_18 = Panel("Innere Ecken Oben")
panel_19 = Panel("Innere Ecken Unten")
move_6 = Move(Geometry=pt_4, Motion=multiplication_9)  # -> graft(Geometry), Transform
move_7 = Move(Geometry=pt_4, Motion=multiplication_10)  # -> graft(Geometry), Transform
move_8 = Move(Geometry=move_7.Geometry, Motion=Z_4)  # -> Geometry, Transform
move_9 = Move(Geometry=move_6.Geometry, Motion=Z_4)  # -> Geometry, Transform
panel_20 = Panel("Äußere Ecken Oben")
panel_21 = Panel("Äußere Ecken Unten")
move_10 = Move(Geometry=move_6.Geometry, Motion=multiplication_8)  # -> Geometry, Transform
move_11 = Move(Geometry=move_10.Geometry, Motion=Z_4)  # -> Geometry, Transform
move_12 = Move(Geometry=move_7.Geometry, Motion=multiplication_8)  # -> Geometry, Transform
move_13 = Move(Geometry=move_12.Geometry, Motion=Z_4)  # -> Geometry, Transform
panel_22 = Panel(move_11.Geometry)
pline = PolyLine(Vertices=[move_9.Geometry, move_11.Geometry, move_13.Geometry, move_8.Geometry], Closed=Toggle(True))
pline_2 = PolyLine(Vertices=[move_6.Geometry, move_7.Geometry, move_12.Geometry, move_10.Geometry], Closed=Toggle(True))
pline_3 = PolyLine(Vertices=[move_6.Geometry, move_10.Geometry, move_11.Geometry, move_9.Geometry], Closed=Toggle(True))
pline_4 = PolyLine(Vertices=[move_12.Geometry, move_7.Geometry, move_8.Geometry, move_13.Geometry], Closed=Toggle(True))
fpatch = FragmentPatch(Boundary=pline)
fpatch_2 = FragmentPatch(Boundary=pline_2)
fpatch_3 = FragmentPatch(Boundary=pline_3)
fpatch_4 = FragmentPatch(Boundary=pline_4)
panel_23 = Panel("Tangente Vektor")
panel_24 = Panel("Dicke Rahmen")
panel_25 = Panel("Oben")
panel_26 = Panel("Unten")
panel_27 = Panel("1")
panel_28 = Panel("2")
vec_3 = Vector(vec)
item_4 = ListItem(List=vec_3, Index="1", Wrap=True)
dicke_rahmen = Slider(0.03, range=0..0.1)
num_15 = Number(dicke_rahmen)
neg_3 = Negative(Value=num_15)
Z_5 = UnitZ(Factor=neg_3)
move_14 = Move(Geometry=move_7.Geometry, Motion=Z_5)  # -> Geometry, Transform
move_15 = Move(Geometry=move_6.Geometry, Motion=Z_5)  # -> Geometry, Transform
join = BrepJoin(Breps=[fpatch, fpatch_3, fpatch_4, pline_2])  # -> Breps, Closed
multiplication_11 = Multiplication(A=item_4, B=dicke_rahmen)
panel_30 = Panel("Dicke Fußplatte")
vec_4 = Vector(multiplication_11)
offsetbrep = OffsetBrep(Brep=join.Breps, OffsetDistance=dicke_rahmen, Solid=Toggle(True), SharpEdges=True, Tolerance=0.01)
rev = Reverse(Vector=vec_4)
output_fensterrahmen = Data(offsetbrep)
num_16 = Number(dicke_rahmen)
num_17 = Number(dicke_rahmen)
move_16 = Move(Geometry=move_15.Geometry, Motion=rev)  # -> Geometry, Transform
move_17 = Move(Geometry=move_14.Geometry, Motion=vec_4)  # -> Geometry, Transform
num_18 = Number(num_13)
output_fensterrahmen_2 = ClusterOutput(output_fensterrahmen)
addition_2 = Addition(A=num_16, B=num_17)
subtraction_3 = Subtraction(A=num_18, B=addition_2)
panel_32 = Panel("Türblatt Grundform")
neg_4 = Negative(Value=subtraction_3)
Z_6 = UnitZ(Factor=neg_4)
move_18 = Move(Geometry=move_16.Geometry, Motion=Z_6)  # -> Geometry, Transform
move_19 = Move(Geometry=move_17.Geometry, Motion=Z_6)  # -> Geometry, Transform
pline_5 = PolyLine(Vertices=[move_17.Geometry, move_16.Geometry, move_18.Geometry, move_19.Geometry], Closed=Toggle(True))
fpatch_5 = FragmentPatch(Boundary=pline_5)
panel_33 = Panel("Normal Vektor Wand")
vec_5 = Vector(evalsrf.Normal)
num_19 = Number(num_11)
item_5 = ListItem(List=vec_5, Index="1", Wrap=True)
multiplication_12 = Multiplication(A=num_19, B=Slider(0.5, range=0..1))
multiplication_13 = Multiplication(A=item_5, B=multiplication_12)
move_20 = Move(Geometry=fpatch_5, Motion=multiplication_13)  # -> Geometry, Transform
G = ClusterOutput(move_20.Geometry)
offsrf = OffsetSurface(Surface=move_20.Geometry, Distance=Slider(0.05, range=0..0.1), BothSides=0, CreateSolid=True)
output_glas = Data(offsrf)
output_glas_2 = ClusterOutput(output_glas)
